# Grasshopper definition server_space_syntax.gh (Grasshopper 1.0.7)
# plug-ins: Kangaroo2 Components, Shortest Walk in Gh

# ----
# Floor distribution Hospital
# Hospital: LNS Pub H
# ER
# Admin H
# Pharmacy
# W.C H-0
# Lift H-0
# Airlocks
# Reception
# Vital Sign
# Clinics
# Surgery
# Med Robots
# W.C H-01
# Lift H-01
# Staff
# Medical Lab
# W.C H-02
# Lift H-02
# Nurse Sta
# Recovery
# ICU
# W.C H-03
# Lift H-03
_0_floor = Panel("""0
1
2
3
4
5
6""")
_1_floor = Panel("""7
8
9
10
11
12
13""")
_2_floor = Panel("""14
15
16
17""")
_3_floor = Panel("""18
19
20
21
22""")
merge = Merge(Data1=_0_floor, Data2=_1_floor, Data3=_2_floor, Data4=_3_floor)  # -> flatten(Result)
sort_list = SortList(Keys=merge)  # -> Keys, ValuesValuesA
check_if_all_floors_are_connected = Panel(sort_list.Keys)
hospital_area = Panel("""20
60
20
15
15
20
15
20
15
30
24
12
15
20
15
20
15
20
15
16
16
15
20""")
connection_logic = Panel("""3 4
0
5
5
5 12
0 13
0
9 13 12
9 10 13
13
11
13 15
13 16
10
15
17 20
17 21
14 22
19 20 22
20
22
22
19""")
names_of_overall_connection_logic = Panel("""2
3
1 3
0
2
4
1
3
9 7
10 0
11 2 4
5""")

height_of_the_room = Panel("3.5")
areas = Panel("""20
80
150
80
50
120
20
60
20
20
20
20""")
lab_area = Panel("""20
20
20
20
20
15
15
20
15
15
150
15
50
60
15
20
15
30
20
15
20""")
set_area = GetString(lab_area, AtLeast=1, AtMost=2147483647)

# ----
# Floor distribution
_0_floor_2 = Panel("""0
1
2
3
4
5""")
_1_floor_2 = Panel("""6
7
8
9
10""")
_2_floor_2 = Panel("""11
12
13
14
15
16""")
_3_floor_2 = Panel("""17
18
19
20""")
merge_2 = Merge(Data1=_0_floor_2, Data2=_1_floor_2, Data3=_2_floor_2, Data4=_3_floor_2)  # -> flatten(Result)
sort_list_2 = SortList(Keys=merge_2)  # -> Keys, ValuesValuesA
check_if_all_floors_are_connected_2 = Panel(sort_list_2.Keys)
lab = Panel("""Lift L-0
LNS Res L
Loading
Rovers
O2/H20 Sup
Airlocks
W.C L-01
Lift L-01
Airlocks
Bio-Tech
Proto
Admin L
Staff
Robots Bay
W.C L-02
Lift L-02
Airlocks L-02
Data Cent
RF Signal
W.C L-03
Lift L-03""")
lab_area_2 = Panel(set_area)
overall_connection_logic = Panel("""1 2 7
2 3 4 5
10
0
0
2
7 14
9 15
10
10
7
12 13
15
15
15 19
11 20
13
18 19
20
20
17""")

# ----
# Lab function per floor
entwine = Entwine(Branch00=_0_floor_2, Branch01=_1_floor_2, Branch02=_2_floor_2, Branch03=_3_floor_2, FlattenInputs=True)
lab_function_per_floor = Data(entwine)
panel = Panel(lab_function_per_floor)

sort_list_3 = SortList(Keys=lab_area_2)  # -> Keys, ValuesValuesA
list_item = ListItem(List=sort_list_3.Keys, Index=0, Wrap=True)  # -> Item1, Item
max_area = Panel(list_item.Item1)
min_area = Panel(list_item.Item)

graft_tree = GraftTree(Tree=lab_area_2, IncludeEmptyLists=True, IncludeNullItems=True)  # -> simplify(Tree)
lab_area_3 = Panel(graft_tree)

seperator_is_space = Panel(" ")
text_split = TextSplit(Text=overall_connection_logic, Separators=seperator_is_space)  # -> simplify(Result)
main_connections = Panel(text_split)

merged_connections = Data(text_split)
main_connection_logic = Data(merged_connections)
panel_2 = Panel(main_connection_logic)
tree_statistics = TreeStatistics(Tree=main_connection_logic)  # -> Paths, Length, Count

# ----
# alternative <index>
# alternative <index>
list_length = ListLength(List=main_connection_logic)
list_length_2 = ListLength(List=main_connection_logic)
duplicate_data = DuplicateData(Data="0", Number=list_length, Order=True)  # -> simplify(Data)
series = Series(Start="0", Step="1", Count=list_length_2)

panel_3 = Panel("""1
2
5
6""")
# grab the first sphere to connect from
# first item
# from the branch
# alternative <index>
# alternative <index>
# Create right paths
# Specify connections in divided functions
panel_4 = Panel("""6
1
54
5""")
ghpython_script = GhPythonScript()  # -> a; inputs x: list
# ---------- ghpython_script: Python ----------
import rhinoscriptsyntax as rs


repeats_count = 0


for xi in x:
  if (xi - y) < z:
    repeats_count = repeats_count + 1

if repeats_count >= 2:
  a = 0
else:
  a = 1
  
print z
# ---------- end ghpython_script ----------

# ----
# Outer ring
number_slider = Slider(17, range=0..100)
number_slider_2 = Slider(0.25, range=0..1)
multiplication = Multiplication(A=number_slider, B=number_slider_2)
polygon = Polygon(Plane=PlaneXY(0, 0, 0), Radius=number_slider, Segments="6", FilletRadius=multiplication)  # -> Polygon, Length

# ----
# Atrium
number_slider_3 = Slider(4, range=0..100)
multiplication_2 = Multiplication(A=number_slider_3, B=number_slider_2)
polygon_2 = Polygon(Plane=PlaneXY(0, 0, 0), Radius=number_slider_3, Segments="6", FilletRadius=multiplication_2)  # -> Polygon, Length

number_slider_4 = Slider(32, range=0..100)
merge_3 = Merge(Data1=polygon.Polygon, Data2=polygon_2.Polygon)
group = Group(Objects=merge_3)
scale_nu = ScaleNU(Geometry=group, Plane=PlaneXY(0, 0, 0), ScaleX=Slider(2.906, range=0.75..3), ScaleY=1, ScaleZ=1)  # -> Geometry, Transform

# ----
# Andrew hexagon
# SHAPE
hospital = Curve(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)
initial_curve = Curve(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)
lab_2 = Curve(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)
merge_4 = Merge(Data1=initial_curve, Data2=lab_2, Data3=hospital)
group_2 = Group(Objects=merge_4)
_2d_geo = Geometry(group_2)
bounding_box = BoundingBox(Content=_2d_geo, Plane=PlaneXY(0, 0, 0))  # -> Box, Box_2
area = Area(Geometry=bounding_box.Box)  # -> Area, Centroid
number_slider_5 = Slider(0.5, range=0.5..2.5)
rotate = Rotate(Geometry=_2d_geo, Angle=degrees("90"), Plane=area.Centroid)  # -> Geometry, Transform
bounding_box_2 = BoundingBox(Content=rotate.Geometry, Plane=PlaneXY(0, 0, 0))  # -> Box, Box_2
area_2 = Area(Geometry=bounding_box_2.Box)  # -> Area, Centroid
floor_height = Panel("5")
scale_nu_2 = ScaleNU(Geometry=rotate.Geometry, Plane=area_2.Centroid, ScaleX=number_slider_5, ScaleY=Slider(0.3378, range=0.1..1.2), ScaleZ=1)  # -> Geometry, Transform
multiplication_3 = Multiplication(A=Slider(4, range=1..5), B=floor_height)
unit_z = UnitZ(Factor=multiplication_3)
ungroup = Ungroup(Group=scale_nu_2.Geometry)
extrude = Extrude(Base=ungroup, Direction=unit_z)
cap_holes = CapHoles(Brep=extrude)
list_item_2 = ListItem(List=cap_holes, Index=0, Wrap=True)  # -> flatten(Item), flatten(Item1), flatten(Item2)
quad_remesh = QuadRemesh(Mesh=cap_holes, Settings={aqc=True, as=50, dhe=True, gci=0, null=False, pme=0, sa=0, tqc=2000})
merge_5 = Merge(Data1=list_item_2.Item1, Data2=list_item_2.Item2)
boundary_divided = Data(merge_5)

scale_nu_3 = ScaleNU(
    Geometry=rotate.Geometry,
    Plane=area_2.Centroid,
    ScaleX=Slider(0.9861, range=0.5..2.5),
    ScaleY=Slider(0.3667, range=0.1..1.2),
    ScaleZ=1)  # -> Geometry, Transform

# ----
# Initial balls position
# Define initial locations for certain funcitons
scale = Scale(Geometry=list_item_2.Item, Center=area_2.Centroid, Factor=number_slider_5)  # -> Geometry, Transform
extrude_2 = Extrude(Base=scale.Geometry, Direction=unit_z)
# DEFINE COLOR PALLETTE
# Text tags
# Create connection lines
# Floor planes
# parametrize initial positions
cap_holes_2 = CapHoles(Brep=extrude_2)  # disabled

extrude_3 = Extrude(Base=list_item_2.Item, Direction=unit_z)
data = Data(list_item_2.Item1)
constraint_strength = Panel("100")
plane_point_collide_constraint = Panel("1000")
pull_and_collide_strength = Panel("150")
value_list = ValueList({"Full area display": 0, "Combined area display": 1}, selected="Combined area display")

# ----
# Check if
# doesn't
# work well
number_slider_6 = Slider(0.75, range=0.1..1.5)

panel_5 = Panel("""0
1
2
3""")
graft_tree_2 = GraftTree(Tree=panel_5, IncludeEmptyLists=True, IncludeNullItems=True)  # -> simplify(Tree)
path_mapper = PathMapper(graft_tree_2, source="{A}", target="{A;0;0}")

# ----
# Select communication
number_slider_7 = Slider(0.25, range=0..2.5)

colour_swatch = ColourSwatch(SwatchColor=RGB(0, 0, 0))

# ----
# Hide/show plans
pick_type = ValueList({"Divided functions": 0, "Joined function": 1}, selected="Divided functions")
pick_type_2 = ValueList({"Withouth corridors": 0, "With corridors": 1}, selected="With corridors")
pick_floor = Slider(4, range=0..4)

pick_gate = Panel(pick_type)
merge_6 = Merge()
select_floor = GetInteger(pick_floor, AtLeast=1, AtMost=2147483647, Maximum=4, Minimum=0)

# ----
# Select floor
panel_6 = Panel("""0
1
2
3""")
graft_tree_3 = GraftTree(Tree=panel_6, IncludeEmptyLists=True, IncludeNullItems=True)
path_mapper_2 = PathMapper(panel_6, source="{A}", target="{0;4}")
merge_7 = Merge(Data1=graft_tree_3, Data2=path_mapper_2)
data_2 = Data(merge_7)
number_slider_8 = Slider(1, range=0..50)
tree_statistics_2 = TreeStatistics(Tree=data_2)  # -> Paths, Length, Count
list_item_3 = ListItem(List=tree_statistics_2.Paths, Index=select_floor, Wrap=True)
tree_branch = TreeBranch(Tree=data_2, Path=list_item_3, MaintainPaths=True)  # -> flatten(Branch)

select_display_mode = GetInteger(Slider(3, range=0..3), AtLeast=1, AtMost=2147483647, Maximum=3, Minimum=0)

# ----
# Boundary line thickness
panel_7 = Panel("0.1")
stream_filter = StreamFilter(Gate=select_display_mode, Stream0="0.4", Stream1=panel_7, Stream2=panel_7, Stream3=panel_7)

# ----
# Highlight comm
number_slider_9 = Slider(0.25, range=0..2.5)

# ---- group: RH_IN:Show_boundary
boolean_toggle = BooleanToggle(False)

# ----
boundary = Data(list_item_2.Item)
brep_edges = BrepEdges(Brep=boundary)  # -> Naked, Interior, NonManifold
equality = Equality(FirstNumber=select_display_mode, SecondNumber="3")  # -> Equality, Inequality
stream_filter_2 = StreamFilter(Gate=boolean_toggle, Stream1=brep_edges.Interior)
boolean_toggle_2 = BooleanToggle(True)
gate_or = GateOr()
panel_8 = Panel(tree_branch)

# ---- group: RH_OUT:boundary_lines
crv = Curve(stream_filter_2)

# ----
# Highlight comm
number_slider_10 = Slider(0.25, range=0..2.5)

colour_swatch_2 = ColourSwatch(SwatchColor=RGB(0, 255, 30))
boolean_toggle_3 = BooleanToggle(True)
panel_9 = Panel("{0.5, 0.5, 0}")

# ----
# Area multiplier
number_slider_11 = Slider(0.75, range=0.5..1.25)
factor_to_alter_distance_between_functio = Slider(0.96, range=0.5..1)  # "Factor to alter distance between function clusters"
factor_to_alter_all_distances = Slider(1, range=0.2..1)
desired_area_per_sphere = Panel("15")
corridor_width_m = Panel("1.5")

desired_area_per_sphere_2 = Panel(desired_area_per_sphere)
ghpython_script_2 = GhPythonScript(x=lab_area_3, y=desired_area_per_sphere_2)  # -> out, a, div_num; inputs x: list, y: list
# ---------- ghpython_script_2: Python ----------
__author__ = "solty"
__version__ = "2021.02.03"

import rhinoscriptsyntax
import math

b=[]
c=[]

if x[0] > y[0]:
    
    b = x[0] % y[0]
    c = (x[0] - b) / y[0]
    a = y[0] + (b / c)
    div_num = c
else:
    a = x
    b = 'null'
    div_num = 1
print x
print y
print a
print b
# ---------- end ghpython_script_2 ----------
areas_2 = Panel(ghpython_script_2.a)
division_of_each_function = Panel(ghpython_script_2.div_num)
duplicate_data_2 = DuplicateData(Data=ghpython_script_2.a, Number=ghpython_script_2.div_num, Order=True)  # -> simplify(Data)
lab_area_4 = Panel(duplicate_data_2)
indices = ListIndices(list=duplicate_data_2)
# Rename functions
lab_area_5 = Panel(indices)
duplicate_data_3 = DuplicateData(Data=graft(lab), Number=ghpython_script_2.div_num, Order=True)  # -> simplify(Data)
cross_reference = CrossReference(ListListA=indices, ListListB=indices, CrossMode=7)  # -> ListListA, ListListB
interconnection_logic = Panel(cross_reference.ListListA)
list_length_3 = ListLength(List=duplicate_data_3)
names = Panel(duplicate_data_3)
series_2 = Series(Start="0", Step="1", Count=list_length_3)
interconnection_logic_2 = Panel(cross_reference.ListListB)
concatenate = Concatenate(Fragment_A=duplicate_data_3, A="_", Fragment_B=series_2)
# checking the logic behind connections
lab_names = Panel(concatenate)

simplify_tree = SimplifyTree(Tree=concatenate, Front=False)

lab_names_2 = Panel(simplify_tree)
panel_10 = Panel(simplify_tree)

# ----
# Specify connections in divided functions
# Cross reference logic: Use upper strict to label the connections based on the last values >> later specify the overall connection based on first item of the list
flatten_tree = FlattenTree(Tree=duplicate_data_2, Path="{0}")
indices_2 = ListIndices(list=flatten_tree)
unflatten_tree = UnflattenTree(Tree=indices_2, Guide=duplicate_data_2)
function_indices = Data(unflatten_tree)
cross_reference_2 = CrossReference(ListListA=function_indices, ListListB=function_indices, CrossMode=7)  # -> ListListA, ListListB
interconnection_logic_3 = Panel(cross_reference_2.ListListA)
interconnection_logic_4 = Panel(cross_reference_2.ListListB)
flatten_tree_2 = FlattenTree(Tree=cross_reference_2.ListListA, Path="{0}")
interconnection_logic_5 = Panel(flatten_tree_2)
flatten_tree_3 = FlattenTree(Tree=cross_reference_2.ListListB, Path="{0}")
interconnection_logic_6 = Panel(flatten_tree_3)

indices_on_branches = Data(function_indices)
rephrased_names = Panel(concatenate)
indices_on_branches_2 = Panel(indices_on_branches)
function_indices_2 = Panel(function_indices)
tree_branch_2 = TreeBranch(Tree=indices_on_branches_2, Path=tree_statistics.Paths, MaintainPaths=True)

# ----
# Create right paths
list_item_4 = ListItem(List=tree_branch_2, Index=duplicate_data, Wrap=True)
tree_statistics_3 = TreeStatistics(Tree=list_item_4)  # -> Paths, Length, Count
list_item_5 = ListItem(List=tree_branch_2, Index=0, Wrap=True)
construct_path = ConstructPath(Indices=list_item_5)  # -> flatten(Branch)
replace_paths = ReplacePaths(Data=list_item_4, Search=tree_statistics_3.Paths, Replace=construct_path)
panel_11 = Panel(construct_path)

# ----
# grab the first sphere to connect from
tree_statistics_4 = TreeStatistics(Tree=indices_on_branches_2)  # -> Paths, Length, Count
list_item_6 = ListItem(List=tree_statistics_4.Paths, Index=main_connection_logic, Wrap=True)
tree_branch_3 = TreeBranch(Tree=indices_on_branches_2, Path=list_item_6, MaintainPaths=False)
list_item_7 = ListItem(List=tree_branch_3, Index=0, Wrap=True)
flatten_tree_4 = FlattenTree(Tree=list_item_7, Path="{0}")
unflatten_tree_2 = UnflattenTree(Tree=flatten_tree_4, Guide=replace_paths)

list_length_4 = ListLength(List=flatten_tree)
series_3 = Series(Start="0", Step="1", Count=list_length_4)
c_script_create_tree = CSharpScript(path=flatten_tree_3, data=flatten_tree_2)  # -> out, r; inputs path: Int32, data: Int32
# ---------- c_script_create_tree: C# usings ----------
using System.Linq;
using Grasshopper.Kernel.Special;
# ---------- c_script_create_tree: C# ----------
    Grasshopper.DataTree<int> tree = new Grasshopper.DataTree<int>();

    tree.Add(data, new GH_Path(path));


    r = tree;
# ---------- end c_script_create_tree ----------
interconnection_logic_7 = Panel(c_script_create_tree.r)

null_item = NullItem(Item=c_script_create_tree.r)  # -> NullFlags, InvalidFlags, Description
main_connection_on_branches = Panel(unflatten_tree_2)
interconnection_logic_8 = Panel(null_item.NullFlags)
merge_8 = Merge(Data1=unflatten_tree_2, Data2=c_script_create_tree.r)

# ----
# Inter room connections
indices_3 = ListIndices(list=c_script_create_tree.r)
indices_4 = ListIndices(list=merge_8)
list_length_5 = ListLength(List=c_script_create_tree.r)
split_list = SplitList(List=indices_4, Index=list_length_5)  # -> ListA, ListB
interconnection_indices = Data(split_list.ListA)

all_connections = Panel(split_list.ListA)
all_connections_2 = Panel(merge_8)
interconnection_logic_9 = Panel(indices_3)
flatten_tree_5 = FlattenTree(Tree=lab_names_2, Path="{0}")
lab_3 = Panel(flatten_tree_5)

overall_connectivity = Data(merge_8)
connectivity = Data(overall_connectivity)

areas_3 = Data(flatten(duplicate_data_2))
lab_area_6 = Panel(areas_3)

initial_room_names = Data(lab_3)
initial_areas = Data(lab_area_6)

# ----
# Area multiplier
panel_12 = Panel(number_slider_11)
multiplication_4 = Multiplication(A=initial_areas, B=panel_12)

areas_4 = Data(multiplication_4)

# ----
# Calculate volume
height_of_the_room_2 = Panel(height_of_the_room)
multiplication_5 = Multiplication(A=areas_4, B=height_of_the_room_2)
volumes = Data(multiplication_5)

function_indices_initial_function_branch = Data(function_indices)  # "Function indices INITIAL FUNCTION BRANCHES"
panel_13 = Panel(areas_4)
list_length_6 = ListLength(List=flatten(indices_on_branches))

# ----
# Initial balls position
point_lab = Point(Point(0.06367439382, -0.1472277506, 0))
rectangle = Rectangle(Plane=point_lab, XSize="-15 to 15", YSize="-15 to 15", Radius=0)  # -> Rectangle, Length
populate_2d = Populate2D(Region=rectangle.Rectangle, Count=list_length_6, Seed=1)
graft_tree_4 = GraftTree(Tree=flatten(populate_2d), IncludeEmptyLists=True, IncludeNullItems=True)  # -> simplify(Tree)

# ----
# pick lift for LAB
set_communication = Panel("""0
7
15
20""")
data_3 = Data(function_indices_initial_function_branch)
tree_statistics_5 = TreeStatistics(Tree=data_3)  # -> Paths, Length, Count
list_item_8 = ListItem(List=tree_statistics_5.Paths, Index=set_communication, Wrap=True)
tree_branch_4 = TreeBranch(Tree=data_3, Path=list_item_8, MaintainPaths=True)
flatten_tree_6 = FlattenTree(Tree=tree_branch_4, Path="{0}")

graft_tree_5 = GraftTree(Tree=initial_room_names, IncludeEmptyLists=True, IncludeNullItems=True)  # -> simplify(Tree)
ghpython_script_3 = GhPythonScript(x=areas_4)  # -> out, a
# ---------- ghpython_script_3: Python ----------
__author__ = "solty"
__version__ = "2021.02.03"

import rhinoscriptsyntax as rs
import math

pi = math.pi

a = math.sqrt(x/pi)
# ---------- end ghpython_script_3 ----------

# ----
# Get the RADIUS
expression = Expression(x=areas_4, Expression="sqrt(x / pi)")
ghpython_script_4 = GhPythonScript(x=volumes)  # -> out, a
# ---------- ghpython_script_4: Python ----------
__author__ = "solty"
__version__ = "2021.02.03"

import rhinoscriptsyntax as rs
import math

pi = math.pi
B = 1/3
C = (3*x)/(4*pi)

a = pow(C,B)
# ---------- end ghpython_script_4 ----------
panel_14 = Panel(ghpython_script_3.a)
radius = Panel(ghpython_script_4.a)
graft_tree_6 = GraftTree(Tree=panel_14, IncludeEmptyLists=True, IncludeNullItems=True)
room_radius = Panel(graft_tree_6)
list_item_9 = ListItem(List=panel_14, Index=connectivity, Wrap=True)
addition = Addition(A=graft_tree_6, B=list_item_9)
room_connection_length = Panel(addition)

room_name = Panel(graft_tree_5)
room_connection_lines = Panel(connectivity)
panel_15 = Panel(factor_to_alter_distance_between_functio)

# ----
# Alter interconnection length
interconnection_indices_2 = Data(interconnection_indices)
list_item_10 = ListItem(List=addition, Index=interconnection_indices_2, Wrap=True)
multiplication_6 = Multiplication(A=list_item_10, B=panel_15)
replace_items = ReplaceItems(List=addition, Item=multiplication_6, Indices=interconnection_indices_2, Wrap=False)
trim_tree = TrimTree(Tree=replace_items, Depth="1")

# ----
# Length multiplier
overall_length_multiplier = Panel(factor_to_alter_all_distances)
multiplication_7 = Multiplication(A=trim_tree, B=overall_length_multiplier)

line_lengths = Data(multiplication_7)
desired_lengths = Panel(trim_tree)

names_on_branches = Data(simplify_tree)
indices_on_branches_3 = Data(indices_on_branches)

names_on_branches_2 = Data(simplify_tree)
tstat = TreeStatistics(Tree=names_on_branches_2)  # -> Paths, Length, Count

# ---- group: RH_OUT:int_cluster_lengths
int = Integer(tstat.Length)

# ----
corridor_width = Panel(corridor_width_m)

# ----
# Define initial locations for certain funcitons
set_communication_2 = Panel(flatten_tree_6)
concatenate_2 = Concatenate(Fragment_A="{", Fragment_B=set_communication_2, A="}")
split_tree = SplitTree(Data=graft_tree_4, Masks=flatten(concatenate_2))  # -> Positive, Negative

# ----
# Move here comm V LAB
list_length_7 = ListLength(List=flatten(split_tree.Positive))
point = Point(Point(-7.755992704, 0.1361355647, 0))
point_2 = Point(Point(-5.152722012, 0.1361355647, 0))
series_4 = Series(Start=0, Step=1, Count=list_length_7)
unit_z_2 = UnitZ(Factor=series_4)
move = Move(Geometry=point, Motion=unit_z_2)  # -> Geometry, Transform
graft_tree_7 = GraftTree(Tree=move.Geometry, IncludeEmptyLists=True, IncludeNullItems=True)
match_tree = MatchTree(Tree=graft_tree_7, Guide=split_tree.Positive)
vector_2pt = Vector2Pt(PointA=split_tree.Positive, PointB=match_tree, Unitize=False)  # -> Vector, Length

move_2 = Move(Geometry=split_tree.Positive, Motion=vector_2pt.Vector)  # -> Geometry, Transform
merge_9 = Merge(Data1=move_2.Geometry, Data2=split_tree.Negative)

# ----
# Create connection lines
grafted_points = Data(merge_9)
list_item_11 = ListItem(List=flatten(grafted_points), Index=connectivity, Wrap=True)
line = Line(StartPoint=grafted_points, EndPoint=list_item_11)

room_centers = Point(flatten(grafted_points))
connection_lines = Data(line)
line_lengths_2 = Data(multiplication_7)
room_radius_2 = Data(panel_14)
boundary_2 = Data(list_item_2.Item)

# ----
# Assign floors to rooms
function_indices_3 = Panel(function_indices)
initial_room_names_2 = Panel(lab)
room_names = Panel(initial_room_names)
room_center_points = Panel(room_centers)
_0_floor_3 = Panel(_0_floor_2)
_1_floor_3 = Panel(_1_floor_2)
_2_floor_3 = Panel(_2_floor_2)
_3_floor_3 = Panel(_3_floor_2)
entwine_2 = Entwine(Branch00=_0_floor_3, Branch01=_1_floor_3, Branch02=_2_floor_3, Branch03=_3_floor_3, FlattenInputs=True)

removeduplicatelines = RemoveDuplicateLines(Lines=flatten(line), Tolerance=0.01)
list_length_8 = ListLength(List=flatten(connection_lines))
list_length_9 = ListLength(List=flatten(removeduplicatelines))
ghpython_script_5 = GhPythonScript(x=list_length_8, y=list_length_9)  # -> out, a
# ---------- ghpython_script_5: Python ----------
__author__ = "solty"
__version__ = "2021.02.03"

import rhinoscriptsyntax

if x == y:
    a = 'No overlap'
else:
    a= 'Lines overlapping'
# ---------- end ghpython_script_5 ----------
check_if_there_are_duplicate_lines = Panel(ghpython_script_5.a)

# ----
# Area per floor
data_4 = Data(duplicate_data_2)
tree_statistics_6 = TreeStatistics(Tree=data_4)  # -> Paths, Length, Count
floor_distribiution = Data(entwine_2)
list_item_12 = ListItem(List=tree_statistics_6.Paths, Index=floor_distribiution, Wrap=True)
explode_tree = ExplodeTree(Data=list_item_12)  # -> Branch0, Branch1, Branch2, Branch3
panel_16 = Panel(list_item_12)
tree_branch_5 = TreeBranch(Tree=data_4, Path=explode_tree.Branch0, MaintainPaths=False)
tree_branch_6 = TreeBranch(Tree=data_4, Path=explode_tree.Branch1, MaintainPaths=False)
tree_branch_7 = TreeBranch(Tree=data_4, Path=explode_tree.Branch2, MaintainPaths=False)
tree_branch_8 = TreeBranch(Tree=data_4, Path=explode_tree.Branch3, MaintainPaths=False)
entwine_3 = Entwine(Branch00=tree_branch_5, Branch01=tree_branch_6, Branch02=tree_branch_7, Branch03=tree_branch_8, FlattenInputs=True)
mass_addition = MassAddition(Input=entwine_3)  # -> Result, PartialResults
area_per = Panel(mass_addition.Result)

# ----
# Assign indices to floor
data_5 = Data(function_indices_3)
tree_statistics_7 = TreeStatistics(Tree=data_5)  # -> Paths, Length, Count
floor_distribiution_2 = Data(entwine_2)
list_item_13 = ListItem(List=tree_statistics_7.Paths, Index=floor_distribiution_2, Wrap=True)
explode_tree_2 = ExplodeTree(Data=list_item_13)  # -> Branch0, Branch1, Branch2, Branch3
panel_17 = Panel(list_item_13)
tree_branch_9 = TreeBranch(Tree=data_5, Path=explode_tree_2.Branch0, MaintainPaths=False)
tree_branch_10 = TreeBranch(Tree=data_5, Path=explode_tree_2.Branch1, MaintainPaths=False)
tree_branch_11 = TreeBranch(Tree=data_5, Path=explode_tree_2.Branch2, MaintainPaths=False)
tree_branch_12 = TreeBranch(Tree=data_5, Path=explode_tree_2.Branch3, MaintainPaths=False)
entwine_4 = Entwine(Branch00=tree_branch_9, Branch01=tree_branch_10, Branch02=tree_branch_11, Branch03=tree_branch_12, FlattenInputs=True)

# ----
# Assign floors to rooms
centers = Data(room_centers)
unflatten_tree_3 = UnflattenTree(Tree=centers, Guide=function_indices_3)
data_6 = Data(unflatten_tree_3)
tree_statistics_8 = TreeStatistics(Tree=data_6)  # -> Paths, Length, Count
floor_distribiution_3 = Data(entwine_2)
list_item_14 = ListItem(List=tree_statistics_8.Paths, Index=floor_distribiution_3, Wrap=True)
explode_tree_3 = ExplodeTree(Data=list_item_14)  # -> Branch0, Branch1, Branch2, Branch3
panel_18 = Panel(list_item_14)
tree_branch_13 = TreeBranch(Tree=data_6, Path=explode_tree_3.Branch0, MaintainPaths=False)
tree_branch_14 = TreeBranch(Tree=data_6, Path=explode_tree_3.Branch1, MaintainPaths=False)
tree_branch_15 = TreeBranch(Tree=data_6, Path=explode_tree_3.Branch2, MaintainPaths=False)
tree_branch_16 = TreeBranch(Tree=data_6, Path=explode_tree_3.Branch3, MaintainPaths=False)
entwine_5 = Entwine(Branch00=tree_branch_13, Branch01=tree_branch_14, Branch02=tree_branch_15, Branch03=tree_branch_16, FlattenInputs=True)

bounding_box_3 = BoundingBox(Content=boundary_2, Plane=PlaneXY(0, 0, 0))  # -> Box, Box_2
deconstruct_brep = DeconstructBrep(Brep=bounding_box_3.Box)  # -> Faces, Edges, Vertices
merge_10 = Merge(Data1=Slider(0, range=0..11), Data2=Slider(1, range=0..11), Data3=Slider(10, range=0..11))

# ---- group: anchor points
merge_11 = Merge(Data1=flatten(set_communication_2))  # -> flatten(Result)
set_communication_3 = Panel(merge_11)
boolean_toggle_4 = BooleanToggle(True)
list_item_15 = ListItem(List=flatten(room_centers), Index=set_communication_3, Wrap=True)
panel_19 = Panel(plane_point_collide_constraint)
anchorxyz = AnchorXYZ(Point=list_item_15, X=boolean_toggle_4, Y=boolean_toggle_4, Z=False, Strength=panel_19)
path_mapper_3 = PathMapper(anchorxyz, source="{A}", target="{2}")

# ----
# Floor planes
number_slider_12 = Slider(10, range=0..11)
list_item_16 = ListItem(List=deconstruct_brep.Edges, Index=number_slider_12, Wrap=True)
divide_curve = DivideCurve(Curve=list_item_16, Count=Slider(5, range=0..10), Kinks=False)  # -> Points, Tangents, Parameters
panel_20 = Panel("""-1
0""")
cull_index = CullIndex(List=divide_curve.Points, Indices=panel_20, Wrap=True)
construct_plane = ConstructPlane(Origin=cull_index, XAxis=Vector(1, 0, 0), YAxis=Vector(0, 1, 0))

bounding_box_4 = BoundingBox(Content=boundary_2, Plane=PlaneXY(0, 0, 0))  # -> Box, Box_2
volume = Volume(Geometry=bounding_box_4.Box)  # -> Volume, Centroid
bomb = Bomb(Location=volume.Centroid, Points=room_centers, DetonationTime=0, Strength="600", Reset=Button())

# ---- group: Plane partitions
plane = Plane(graft(construct_plane))
match_tree_2 = MatchTree(Tree=plane, Guide=entwine_5)
onplane = OnPlane(Points=entwine_5, Plane=match_tree_2, Strength="1500")

# ----
solidpointcollide = SolidPointCollide(Points=room_centers, Solid=boundary_2, Interior=Toggle(True), Unidirectional=True, Strength="500")

panel_21 = Panel(pull_and_collide_strength)
length_line = LengthLine(Line=connection_lines, Length=line_lengths_2, Strength=panel_21)

panel_22 = Panel(pull_and_collide_strength)
spherecollide = SphereCollide(Points=room_centers, Radius=room_radius_2, Strength=panel_22)

merge_12 = Merge(Data1=bomb, Data2=length_line, Data3=spherecollide, Data4=solidpointcollide, Data5=onplane, Data6=path_mapper_3)  # -> flatten(Result)
merge_13 = Merge(Data1=bomb, Data2=length_line, Data3=spherecollide, Data4=solidpointcollide, Data5=onplane, Data6=path_mapper_3)  # -> flatten(Result)
zombiesolver = ZombieSolver(GoalObjects=merge_12, Threshold="1e-20", Tolerance=0.01, MaxIterations=50000)  # -> I, V, O
iteration_counter = Panel(zombiesolver.I)
point_3 = Point(zombiesolver.V)
distance = Distance(PointA=volume.Centroid, PointB=point_3)
line_2 = Line(zombiesolver.O)
equality_2 = Equality(FirstNumber=distance, SecondNumber="0")  # -> Equality, Inequality
clean_tree = CleanTree(RemoveNulls=True, RemoveInvalid=Toggle(True), RemoveEmpty=False, Tree=line_2)
cull_pattern = CullPattern(List=point_3, CullPattern=invert(equality_2.Equality))

# ---- group: old split lists
list_length_10 = ListLength(List=flatten(line_lengths_2))
split_list_2 = SplitList(List=clean_tree, Index=list_length_10)  # -> ListA, ListB

# ----
clean_tree_2 = CleanTree(RemoveNulls=True, RemoveInvalid=True, RemoveEmpty=False, Tree=cull_pattern)
list_length_11 = ListLength(List=room_centers)
unflatten_tree_4 = UnflattenTree(Tree=split_list_2.ListA, Guide=connection_lines)
split_list_3 = SplitList(List=clean_tree_2, Index=list_length_11)  # -> ListA, ListB
unflatten_tree_5 = UnflattenTree(Tree=split_list_3.ListA, Guide=lab_names_2)
panel_23 = Panel(split_list_3.ListB)
length = Length(Curve=unflatten_tree_4)
actual_lengths = Panel(length)
sphere = Sphere(Base=split_list_3.ListA, Radius=room_radius_2)
mesh_sphere_ex = MeshSphereEx(Base=split_list_3.ListA, Radius=room_radius_2, Count=5)
panel_24 = Panel(split_list_3.ListA)
unflatten_tree_6 = UnflattenTree(Tree=split_list_3.ListA, Guide=lab_names_2)
unflatten_tree_7 = UnflattenTree(Tree=mesh_sphere_ex, Guide=lab_names_2)
unflatten_tree_8 = UnflattenTree(Tree=sphere, Guide=lab_names_2)

spheres_based_on_function = Data(unflatten_tree_8)
interconnection_logic_10 = Data(interconnection_logic_7)
indices_per_floor = Data(floor_distribiution_3)
planes_per_floor = Data(plane)
original_names = Data(lab)
divided_areas = Data(ghpython_script_2.a)
room_centers_2 = Data(unflatten_tree_5)
room_radius_3 = Data(room_radius_2)
div_number = Data(ghpython_script_2.div_num)

list_item_17 = ListItem(List=unflatten_tree_8, Index=0, Wrap=True)

# ----
# DEFINE COLOR PALLETTE
list_length_12 = ListLength(List=flatten(list_item_17))
series_5 = Series(Start=0, Step=1, Count=list_length_12)
remap = Remap(data=series_5, min=Slider(0, range=0..1), max=Slider(1, range=0..1))
gradient = Gradient(
    LowerLimit=0,
    UpperLimit=1,
    Parameter=remap,
    stops=[0: RGB(88, 140, 119), 0.25: RGB(116, 140, 131), 0.5: RGB(47, 64, 57), 0.75: RGB(140, 85, 74), 1: RGB(64, 49, 47)])
gradient_2 = Gradient(
    LowerLimit=0,
    UpperLimit=1,
    Parameter=remap,
    stops=[0: RGB(234, 38, 0), 0.25: RGB(234, 126, 0), 0.5: RGB(254, 244, 84), 0.75: RGB(173, 203, 249), 1: RGB(75, 107, 169)])
graft_tree_8 = GraftTree(Tree=gradient, IncludeEmptyLists=True, IncludeNullItems=True)
colors_to_use_by_orig_function = Data(graft_tree_8)

list_item_18 = ListItem(List=unflatten_tree_6, Index=0, Wrap=True)

bounding_box_5 = BoundingBox(Content=boundary_2, Plane=PlaneXY(0, 0, 0))  # -> Box, Box_2
volume_2 = Volume(Geometry=bounding_box_5.Box)  # -> Volume, Centroid
ellipse = Ellipse(Plane=volume_2.Centroid, Radius1=Slider(45, range=0..200), Radius2=Slider(33, range=0..200))  # -> Ellipse, Focus1, Focus2
seam = Seam(Curve=reparameterize(ellipse.Ellipse), Seam="0.25")
sub_curve = SubCurve(BaseCurve=reparameterize(seam), Domain="0 to 0.5")
list_length_13 = ListLength(List=flatten(list_item_18))
divide_curve_2 = DivideCurve(Curve=ellipse.Ellipse, Count=list_length_13, Kinks=False)  # -> Points, Tangents, Parameters
panel_25 = Panel("""-1
0""")
cull_index_2 = CullIndex(List=divide_curve_2.Points, Indices=panel_25, Wrap=True)  # -> graft(List)

unflatten_tree_9 = UnflattenTree(Tree=split_list_2.ListA, Guide=merge_8)

# ----
# connection lines
join_curves = JoinCurves(Curves=unflatten_tree_4, Preserve=False)  # -> simplify(Curves)

# ----
# Curves to main balls
function_indices_per_exploded_sphere = Data(unflatten_tree)
panel_26 = Panel(function_indices_per_exploded_sphere)
data_7 = Data(join_curves)
tree_statistics_9 = TreeStatistics(Tree=data_7)  # -> Paths, Length, Count
list_length_14 = ListLength(List=data_7)
series_6 = Series(Start="0", Step="1", Count=list_length_14)
list_item_19 = ListItem(List=tree_statistics_9.Paths, Index=function_indices_per_exploded_sphere, Wrap=True)
trim_tree_2 = TrimTree(Tree=series_6, Depth="1")
tree_item = TreeItem(Tree=data_7, Path=list_item_19, Index=trim_tree_2, Wrap=True)

indices_5 = ListIndices(list=original_names)
concatenate_3 = Concatenate(
    H=graft(indices_5),
    G=". ",
    Fragment_A=graft(original_names),
    Fragment_B=": ",
    C=div_number,
    E=" * ",
    D=divided_areas,
    F=" = ",
    A=graft(lab_area_2),
    B=" m2")
concatenate_4 = Concatenate(D=graft(indices_5), C=". ", Fragment_A=graft(original_names), Fragment_B=": ", A=graft(lab_area_2), B=" m2")

# ----
# Wireframe
mesh_edges = MeshEdges(Mesh=boundary_2)  # -> NakedEdges, InteriorEdges, NonManifoldEdges

# ----
# Connection lines
# Dimensions
number_slider_13 = Slider(0.76, range=0..2)
# connection lines
# Dimensions
# Wireframe
number_slider_14 = Slider(1.6, range=0..2)
list_item_20 = ListItem(List=deconstruct_brep.Edges, Index=merge_10, Wrap=True)
line_dimension = LineDimension(Line=list_item_20, Text="{0:0.00}", Size=number_slider_14)  # disabled

stream_filter_3 = StreamFilter(Gate=value_list, Stream0=concatenate_4, Stream1=concatenate_3)

line_geometry = Data(mesh_edges.InteriorEdges)
line_thickness = Data(Slider(0.114, range=0..2))
line_colors = Data(ColourSwatch(SwatchColor=RGB(255, 255, 255)))

data_dam = DataDam(DataDataA=room_radius_3, DataDataA_2=room_centers_2, BufferDelay=10000000, BufferMode=0)  # -> DataDataA, DataDataA_2

# ----
# Indices per floor
divided_indices_on_floors = Data(entwine_4)
explode_tree_4 = ExplodeTree(Data=divided_indices_on_floors)  # -> Branch0, Branch1, Branch2, Branch3
floor_0 = Data(explode_tree_4.Branch0)
floor_1 = Data(explode_tree_4.Branch1)
floor_2 = Data(explode_tree_4.Branch2)
floor_3 = Data(explode_tree_4.Branch3)

# ----
# Floor planes
planes_per_floor_2 = Data(planes_per_floor)
deconstruct = Deconstruct(Point=planes_per_floor_2)  # -> XComponent, YComponent, ZComponent

list_item_21 = ListItem(List=divided_indices_on_floors, Index=0, Wrap=True)

# ----
# Radius per floors
flatten_tree_7 = FlattenTree(Tree=room_radius_3, Path="{0}")
list_item_22 = ListItem(List=flatten_tree_7, Index=divided_indices_on_floors, Wrap=True)

# ----
# unify Z value for each point
flatten_tree_8 = FlattenTree(Tree=room_centers_2, Path="{0}")
list_item_23 = ListItem(List=flatten_tree_8, Index=divided_indices_on_floors, Wrap=True)
deconstruct_2 = Deconstruct(Point=list_item_23)  # -> XComponent, YComponent, ZComponent
construct_point = ConstructPoint(XCoordinate=deconstruct_2.XComponent, YCoordinate=deconstruct_2.YComponent, ZCoordinate=deconstruct.ZComponent)

# ----
# Metaball outline
multiplication_8 = Multiplication(A=list_item_22, B=number_slider_6)
list_item_24 = ListItem(List=construct_point, Index=0, Wrap=True)
metaball_t_custom = MetaBallTCustom(Points=construct_point, Charge=multiplication_8, Plane=list_item_24, Threshold=0.5)

panel_27 = Panel(divided_indices_on_floors)

# ----
# Extra points
list_length_15 = ListLength(List=construct_point)
divide_curve_3 = DivideCurve(Curve=metaball_t_custom, Count=expr("x*2", list_length_15), Kinks=False)  # -> Points, Tangents, Parameters

# ----
# Offset curve based on average room radius per floor
radiuses = Data(list_item_22)
polyline = PolyLine(Vertices=divide_curve_3.Points, Closed=invert(False))
mass_addition_2 = MassAddition(Input=radiuses)  # -> Result, PartialResults
list_length_16 = ListLength(List=radiuses)
circle = Circle(Plane=PlaneXY(0, 0, 0), Radius=1)
division = Division(A=mass_addition_2.Result, B=list_length_16)
flip_curve = FlipCurve(Curve=polyline, Guide=circle)  # -> Curve, Flag
offset_curve = OffsetCurve(Curve=flip_curve.Curve, Distance=division, Plane=PlaneXY(0, 0, 0), Corners=1)
explode = Explode(Curve=offset_curve, Recursive=True)  # -> Segments, Vertices
bounding_box_6 = BoundingBox(Content=offset_curve, Plane=PlaneXY(0, 0, 0), UnionBox=True)  # -> Box, Box_2
deconstruct_brep_2 = DeconstructBrep(Brep=bounding_box_6.Box)  # -> Faces, Edges, Vertices
cull_duplicates = CullDuplicates(Points=explode.Vertices, Tolerance=0.1, CullMode=3)  # -> Points, Indices, Valence
join_curves_2 = JoinCurves(Curves=deconstruct_brep_2.Edges, Preserve=False)
area_3 = Area(Geometry=join_curves_2)  # -> Area, Centroid
scale_2 = Scale(Geometry=join_curves_2, Center=area_3.Centroid, Factor="1.3")  # -> Geometry, Transform

# ----
# Create room boundaries
panel_28 = Panel("5")
trim_tree_3 = TrimTree(Tree=cull_duplicates.Points, Depth=panel_28)
merge_14 = Merge(Data1=construct_point, Data2=trim_tree_3)
voronoi = Voronoi(Points=merge_14, Boundary=scale_2.Geometry, BruteForceOverride=False)
list_length_17 = ListLength(List=construct_point)
split_list_4 = SplitList(List=voronoi, Index=list_length_17)  # -> ListA, ListB
data_8 = Data(split_list_4.ListA)

panel_29 = Panel(trim_tree_3)
panel_30 = Panel(merge_14)
area_4 = Area(Geometry=join_curves_2)  # -> Area, Centroid

# ----
# Full floors massings
planes_per_floor_3 = Data(planes_per_floor)
point_4 = Point(flatten(planes_per_floor_3))
list_item_25 = ListItem(List=point_4, Index=0, Wrap=True)  # -> Item, Item1
distance_2 = Distance(PointA=list_item_25.Item, PointB=list_item_25.Item1)
unit_z_3 = UnitZ(Factor=distance_2)
region_union = RegionUnion(Curves=data_8)
move_3 = Move(Geometry=region_union, Motion=expr("-x/2", unit_z_3))  # -> Geometry, Transform
extrude_4 = Extrude(Base=move_3.Geometry, Direction=unit_z_3)
cap_holes_3 = CapHoles(Brep=extrude_4)

panel_31 = Panel(area_3.Centroid)

# ----
# Put function on branches
list_indices_per_floor = Data(divided_indices_on_floors)
flatten_tree_9 = FlattenTree(Tree=list_indices_per_floor, Path="{0}")
flatten_tree_10 = FlattenTree(Tree=data_8, Path="{0}")
sort_list_4 = SortList(Keys=flatten_tree_9, ValuesValuesA=flatten_tree_10)  # -> Keys, ValuesValuesA
indices_per_function = Data(room_centers_2)
unflatten_tree_10 = UnflattenTree(Tree=sort_list_4.ValuesValuesA, Guide=indices_per_function)

# ----
# Floor heights
planes_per_floor_4 = Data(planes_per_floor)
point_5 = Point(flatten(planes_per_floor_4))
list_item_26 = ListItem(List=point_5, Index=0, Wrap=True)  # -> Item, Item1
distance_3 = Distance(PointA=list_item_26.Item, PointB=list_item_26.Item1)
unit_z_4 = UnitZ(Factor=distance_3)
region_union_2 = RegionUnion(Curves=unflatten_tree_10)
move_4 = Move(Geometry=region_union_2, Motion=expr("-x/2", unit_z_4))  # -> Geometry, Transform
extrude_5 = Extrude(Base=move_4.Geometry, Direction=unit_z_4)
joined_functions = Data(move_4.Geometry)

panel_32 = Panel(flatten_tree_10)
extrude_6 = Extrude(Base=unflatten_tree_10, Direction=unit_z_4)
room_outlines_per_small_sphere = Data(unflatten_tree_10)
panel_33 = Panel(flatten_tree_9)

brep_edges_2 = BrepEdges(Brep=extrude_6)  # -> Naked, Interior, NonManifold
merge_15 = Merge(Data1=brep_edges_2.Naked, Data2=brep_edges_2.Interior, Data3=brep_edges_2.NonManifold)
boolean_toggle_5 = BooleanToggle(True)
clean_tree_3 = CleanTree(RemoveNulls=boolean_toggle_5, RemoveInvalid=boolean_toggle_5, RemoveEmpty=boolean_toggle_5, Tree=merge_15)

move_5 = Move(Geometry=room_outlines_per_small_sphere, Motion=expr("-x/2", unit_z_4))  # -> Geometry, Transform
extrude_7 = Extrude(Base=move_5.Geometry, Direction=unit_z_4)
cap_holes_4 = CapHoles(Brep=extrude_7)
data_to_bake_max_number_of_elem = Data(cap_holes_4)
room_outlines_per_small_sphere_2 = Data(move_5.Geometry)

area_5 = Area(Geometry=unflatten_tree_10)  # -> Area, Centroid
mass_addition_3 = MassAddition(Input=area_5.Area)  # -> Result, PartialResults
cap_holes_5 = CapHoles(Brep=extrude_5)

# ---- group: Data
data_to_bake_max_number_of_elem_2 = Data(data_to_bake_max_number_of_elem)
centers_2 = Data(flatten(data_to_bake_max_number_of_elem_2))

# ----
panel_34 = Panel(mass_addition_3.Result)

# ----
# Assign outlines
room_outlines_per_small_sphere_3 = Data(room_outlines_per_small_sphere_2)
centers_3 = Data(flatten(room_outlines_per_small_sphere_3))
unflatten_tree_11 = UnflattenTree(Tree=centers_3, Guide=function_indices_3)
data_9 = Data(unflatten_tree_11)
original_floor_distribiution = Data(entwine_2)
tree_statistics_10 = TreeStatistics(Tree=data_9)  # -> Paths, Length, Count
list_item_27 = ListItem(List=tree_statistics_10.Paths, Index=original_floor_distribiution, Wrap=True)
explode_tree_5 = ExplodeTree(Data=list_item_27)  # -> Branch0, Branch1, Branch2, Branch3
panel_35 = Panel(list_item_27)
tree_branch_17 = TreeBranch(Tree=data_9, Path=explode_tree_5.Branch0, MaintainPaths=False)
tree_branch_18 = TreeBranch(Tree=data_9, Path=explode_tree_5.Branch1, MaintainPaths=False)
tree_branch_19 = TreeBranch(Tree=data_9, Path=explode_tree_5.Branch2, MaintainPaths=False)
tree_branch_20 = TreeBranch(Tree=data_9, Path=explode_tree_5.Branch3, MaintainPaths=False)
entwine_6 = Entwine(Branch0X=tree_branch_17, Branch1X=tree_branch_18, Branch2X=tree_branch_19, Branch3X=tree_branch_20, FlattenInputs=False)

line_geometry_2 = Data(clean_tree_3)
line_thickness_2 = Data(Slider(0.22, range=0..2.5))
line_colors_2 = Data(ColourSwatch(SwatchColor=RGB(255, 255, 255)))

area_6 = Area(Geometry=region_union_2)  # -> Area, Centroid
flatten_tree_11 = FlattenTree(Tree=area_6.Area, Path="{0}")
actual_area_per_shpere = Panel(flatten_tree_11)

# ----
# Assign names to rooms
centers_4 = Data(flatten(names_on_branches))
unflatten_tree_12 = UnflattenTree(Tree=centers_4, Guide=function_indices_3)
colors_to_use_by_orig_function_2 = Data(flatten(colors_to_use_by_orig_function))
data_10 = Data(unflatten_tree_12)
joined_functions_2 = Data(flatten(joined_functions))
original_floor_distribiution_2 = Data(entwine_2)
original_names_2 = Data(lab)
tree_statistics_11 = TreeStatistics(Tree=data_10)  # -> Paths, Length, Count
original_names_3 = Data(lab)
list_item_28 = ListItem(List=original_names_2, Index=original_floor_distribiution_2, Wrap=True)  # -> simplify(Item)
list_item_29 = ListItem(List=colors_to_use_by_orig_function_2, Index=original_floor_distribiution_2, Wrap=True)  # -> simplify(Item)
list_item_30 = ListItem(List=joined_functions_2, Index=original_floor_distribiution_2, Wrap=True)  # -> simplify(Item)
list_item_31 = ListItem(List=tree_statistics_11.Paths, Index=original_floor_distribiution_2, Wrap=True)
data_to_bake_full_outlines_organized_by = Data(list_item_30)  # "Data to bake - full outlines organized by floor"
explode_tree_6 = ExplodeTree(Data=list_item_31)  # -> Branch0, Branch1, Branch2, Branch3
panel_36 = Panel(list_item_31)
graft_tree_9 = GraftTree(Tree=list_item_28, IncludeEmptyLists=True, IncludeNullItems=True)
tree_branch_21 = TreeBranch(Tree=data_10, Path=explode_tree_6.Branch0, MaintainPaths=False)
tree_branch_22 = TreeBranch(Tree=data_10, Path=explode_tree_6.Branch1, MaintainPaths=False)
tree_branch_23 = TreeBranch(Tree=data_10, Path=explode_tree_6.Branch2, MaintainPaths=False)
tree_branch_24 = TreeBranch(Tree=data_10, Path=explode_tree_6.Branch3, MaintainPaths=False)
tree_statistics_12 = TreeStatistics(Tree=graft_tree_9)  # -> Paths, Length, Count
deconstruct_path = DeconstructPath(Branch=tree_statistics_12.Paths)
entwine_7 = Entwine(Branch0X=tree_branch_21, Branch1X=tree_branch_22, Branch2X=tree_branch_23, Branch3X=tree_branch_24, FlattenInputs=False)
list_item_32 = ListItem(List=deconstruct_path, Index=0, Wrap=True)  # -> flatten(Item)
organized_object_names_of_full_functions = Data(graft_tree_9)
unflatten_tree_13 = UnflattenTree(Tree=list_item_32, Guide=graft_tree_9)

# ----
# Assign geometry to bake
unflatten_tree_14 = UnflattenTree(Tree=centers_2, Guide=function_indices_3)
data_11 = Data(unflatten_tree_14)
original_floor_distribiution_3 = Data(entwine_2)
tree_statistics_13 = TreeStatistics(Tree=data_11)  # -> Paths, Length, Count
list_item_33 = ListItem(List=tree_statistics_13.Paths, Index=original_floor_distribiution_3, Wrap=True)
explode_tree_7 = ExplodeTree(Data=list_item_33)  # -> Branch0, Branch1, Branch2, Branch3
panel_37 = Panel(list_item_33)
tree_branch_25 = TreeBranch(Tree=data_11, Path=explode_tree_7.Branch0, MaintainPaths=False)
tree_branch_26 = TreeBranch(Tree=data_11, Path=explode_tree_7.Branch1, MaintainPaths=False)
tree_branch_27 = TreeBranch(Tree=data_11, Path=explode_tree_7.Branch2, MaintainPaths=False)
tree_branch_28 = TreeBranch(Tree=data_11, Path=explode_tree_7.Branch3, MaintainPaths=False)
entwine_8 = Entwine(Branch0X=tree_branch_25, Branch1X=tree_branch_26, Branch2X=tree_branch_27, Branch3X=tree_branch_28, FlattenInputs=False)

panel_38 = Panel(joined_functions)
panel_39 = Panel(unflatten_tree_10)
panel_40 = Panel(region_union_2)
data_12 = Data(joined_functions)
tree_statistics_14 = TreeStatistics(Tree=data_12)  # -> Paths, Length, Count
param_viewer = ParamViewer(data_12)

# ----
# Check if work
list_item_34 = ListItem(List=joined_functions, Index=0, Wrap=True)

list_length_18 = ListLength(List=flatten(joined_functions))
list_length_19 = ListLength(List=flatten(list_item_34))
equality_3 = Equality(FirstNumber=list_length_18, SecondNumber=list_length_19)  # -> Equality, Inequality
it_should_be_44 = Panel(list_length_18)
all_function_clusters_are_connected = Panel(equality_3.Equality)

all_function_clusters_are_connected_2 = Panel(all_function_clusters_are_connected)
it_should_be_44_number_of_orig_functions = Panel(it_should_be_44)
list_item_35 = ListItem(List=tree_statistics_14.Paths, Index=Slider(12, range=0..50), Wrap=True)
tree_branch_29 = TreeBranch(Tree=data_12, Path=list_item_35, MaintainPaths=True)
path_mapper_4 = PathMapper(entwine_7, source="{A;B}", target="{A;0;B}")
flatten_tree_12 = FlattenTree(Tree=list_item_34, Path="{0}")
each_sphere_per_floor = Panel(entwine_8)
each_sphere_per_floor_2 = Panel(path_mapper_4)
merged_spheres_per_floor = Panel(graft_tree_9)

lab_function_per_floor_2 = Data(entwine)
list_item_36 = ListItem(List=flatten_tree_12, Index=lab_function_per_floor_2, Wrap=True)

# ----
# Lift per floor, per lab/hosp
lab_function_lift = Data(set_communication)
merge_16 = Merge(Data1=graft(lab_function_lift))
graft_tree_10 = GraftTree(Tree=lab_function_lift, IncludeEmptyLists=True, IncludeNullItems=True)
list_item_37 = ListItem(List=flatten_tree_12, Index=graft_tree_10, Wrap=True)

# ----
# Divided function layers
panel_41 = Panel("Divided distribution by floor")
concatenate_5 = Concatenate(
    C=panel_41,
    E="::",
    F=unflatten_tree_13,
    D=". Floor",
    Fragment_A="::",
    Fragment_B=merged_spheres_per_floor,
    A="::",
    B=each_sphere_per_floor_2)  # -> simplify(Result)

# ----
# Joined function layers
panel_42 = Panel(". Floor")
panel_43 = Panel("Joined distribution by floor")
concatenate_6 = Concatenate(
    FragmentC=panel_43,
    FragmentE="::",
    FragmentF=unflatten_tree_13,
    FragmentD=panel_42,
    FragmentA="::",
    FragmentB=merged_spheres_per_floor)  # -> simplify(Result)

# ----
# Joined function region layers
panel_44 = Panel("Joined distribution outlines by floor")
concatenate_7 = Concatenate(
    FragmentC=panel_44,
    FragmentE="::",
    FragmentF=unflatten_tree_13,
    FragmentD=panel_42,
    FragmentA="::",
    FragmentB=merged_spheres_per_floor)  # -> simplify(Result)

# ----
# Corridors layers
panel_45 = Panel("""0
1
2
3""")
graft_tree_11 = GraftTree(Tree=panel_45, IncludeEmptyLists=True, IncludeNullItems=True)
path_mapper_5 = PathMapper(graft_tree_11, source="{A}", target="{A;0;0}")
panel_46 = Panel(panel_41)
panel_47 = Panel(". Floor")
panel_48 = Panel(panel_44)
panel_49 = Panel(panel_43)
concatenate_8 = Concatenate(C=panel_48, E="::", F=graft_tree_11, D=panel_47, Fragment_A="::", Fragment_B="Corridors floor ", A=graft_tree_11)
concatenate_9 = Concatenate(C=panel_49, E="::", F=graft_tree_11, D=panel_47, Fragment_A="::", Fragment_B="Corridors floor ", A=graft_tree_11)
concatenate_10 = Concatenate(C=panel_46, E="::", F=graft_tree_11, D=panel_47, Fragment_A="::", Fragment_B="Corridors floor ", A=graft_tree_11)
panel_50 = Panel(concatenate_8)
panel_51 = Panel(concatenate_9)
panel_52 = Panel(concatenate_10)

indices_per_floor_2 = Data(indices_per_floor)
list_item_38 = ListItem(List=flatten_tree_12, Index=indices_per_floor_2, Wrap=True)
indices_6 = ListIndices(list=list_item_38)
key_value_search = KeyValueSearch(Keys=indices_per_floor_2, Values=indices_6, Search=merge_16)

panel_53 = Panel(indices_per_floor_2)

panel_54 = Panel(list_item_36)
data_13 = Data(list_item_36)
tree_statistics_15 = TreeStatistics(Tree=data_13)  # -> Paths, Length, Count
param_viewer_2 = ParamViewer(data_13)
list_item_39 = ListItem(List=tree_statistics_15.Paths, Index=Slider(1, range=0..3), Wrap=True)
tree_branch_30 = TreeBranch(Tree=data_13, Path=list_item_39, MaintainPaths=True)

panel_55 = Panel(concatenate_5)
panel_56 = Panel(concatenate_6)
colors_to_use_by_orig_function_3 = Data(simplify(colors_to_use_by_orig_function))
panel_57 = Panel(list_item_37)

# ----
# Pick the V communication room
all_regions_as_curves = Data(list_item_38)
number_slider_15 = Slider(0, range=0..51)
lift_index_per_floor = Data(key_value_search)
area_7 = Area(Geometry=all_regions_as_curves)  # -> Area, Centroid
cull_index_3 = CullIndex(List=area_7.Centroid, Indices=lift_index_per_floor, Wrap=True)
cull_index_4 = CullIndex(List=all_regions_as_curves, Indices=lift_index_per_floor, Wrap=True)
list_item_40 = ListItem(List=area_7.Centroid, Index=lift_index_per_floor, Wrap=True)
list_item_41 = ListItem(List=all_regions_as_curves, Index=lift_index_per_floor, Wrap=True)

graft_tree_12 = GraftTree(Tree=key_value_search, IncludeEmptyLists=True, IncludeNullItems=True)
panel_58 = Panel(key_value_search)
argb = SplitARGB(Colour=colors_to_use_by_orig_function_3, IntegerChannels=True)  # -> Alpha, Red, Green, Blue
list_item_42 = ListItem(List=key_value_search, Index=0, Wrap=True)  # -> Item, Item1
panel_59 = Panel(list_item_41)
panel_60 = Panel(graft_tree_12)
merge_17 = Merge(Data1=argb.Red, Data2=argb.Green, Data3=argb.Blue)
join = TextJoin(Text=[argb.Red, argb.Green, argb.Blue], Join=",")  # -> flatten(Result)

data_14 = Data(list_item_38)
tree_statistics_16 = TreeStatistics(Tree=data_14)  # -> Paths, Length, Count
param_viewer_3 = ParamViewer(data_14)
list_item_43 = ListItem(List=tree_statistics_16.Paths, Index=Slider(0, range=0..3), Wrap=True)
tree_branch_31 = TreeBranch(Tree=data_14, Path=list_item_43, MaintainPaths=True)

# ---- group: RH_OUT:int_colors
int_2 = Integer(simplify(merge_17))

# ---- group: RH_OUT:str_colors
txt = Text(join)

# ----
graft_tree_13 = GraftTree(Tree=list_item_40, IncludeEmptyLists=True, IncludeNullItems=True)

# ----
# Force culling
# of duplicates
# and too close points
# Sort verts by dist. and pick closest one
panel_61 = Panel("1")
trim_tree_4 = TrimTree(Tree=cull_index_4, Depth=panel_61)
graft_tree_14 = GraftTree(Tree=trim_tree_4, IncludeEmptyLists=True, IncludeNullItems=True)
explode_2 = Explode(Curve=list_item_41, Recursive=True)  # -> Segments, Vertices
explode_3 = Explode(Curve=graft_tree_14, Recursive=True)  # -> Segments, Vertices
cull_tolerance = Panel("0.6")
cull_duplicates_2 = CullDuplicates(Points=explode_2.Vertices, Tolerance=cull_tolerance, CullMode=3)  # -> Points, Indices, Valence
trim_tree_5 = TrimTree(Tree=explode_3.Vertices, Depth="1")
distance_4 = Distance(PointA=list_item_40, PointB=trim_tree_5)
trim_tree_6 = TrimTree(Tree=cull_duplicates_2.Points, Depth="1")
trim_tree_7 = TrimTree(Tree=explode_3.Segments, Depth="2")
sort_list_5 = SortList(Keys=distance_4, ValuesValuesA=trim_tree_5)  # -> Keys, ValuesValuesA
line_3 = Line(StartPoint=graft_tree_13, EndPoint=trim_tree_6)
list_item_44 = ListItem(List=sort_list_5.ValuesValuesA, Index=0, Wrap=True)
trim_tree_8 = TrimTree(Tree=line_3, Depth="1")
trim_tree_9 = TrimTree(Tree=list_item_44, Depth="1")
merge_18 = Merge(Data1=trim_tree_8, Data2=trim_tree_7)
path_mapper_6 = PathMapper(trim_tree_9, source="{A;B}", target="{A;B;A}")
path_mapper_7 = PathMapper(trim_tree_9, source="{A;B}", target="{A;B;A+1}")
merge_19 = Merge(Data1=path_mapper_6, Data2=path_mapper_7)
line_4 = Line(StartPoint=graft_tree_13, EndPoint=merge_19)
trim_tree_10 = TrimTree(Tree=line_4, Depth="1")

# ----
# Dup data to match the number of points to check
panel_62 = Panel(list_item_40)

line_geometry_3 = Data(list_item_41)
line_thickness_3 = Data(number_slider_7)
line_colors_3 = Data(ColourSwatch(SwatchColor=RGB(255, 255, 255)))

panel_63 = Panel(graft_tree_13)
panel_64 = Panel(explode_2.Vertices)

# ----
# DEFINE COLOR PALLETTE
list_length_20 = ListLength(List=flatten(all_regions_as_curves))
series_7 = Series(Start=0, Step=1, Count=list_length_20)
remap_2 = Remap(data=series_7, min=Slider(0, range=0..1), max=Slider(1, range=0..1))
gradient_3 = Gradient(
    LowerLimit=0,
    UpperLimit=1,
    Parameter=remap_2,
    stops=[0: RGB(234, 38, 0), 0.25: RGB(234, 126, 0), 0.5: RGB(254, 244, 84), 0.75: RGB(173, 203, 249), 1: RGB(75, 107, 169)])
graft_tree_15 = GraftTree(Tree=gradient_3, IncludeEmptyLists=True, IncludeNullItems=True)

# ----
# Text tags
number_slider_16 = Slider(-31, range=-50..50)
graft_tree_16 = GraftTree(Tree=divide_curve_2.Points, IncludeEmptyLists=True, IncludeNullItems=True)
deconstruct_3 = Deconstruct(Point=list_item_18)  # -> XComponent, YComponent, ZComponent
deconstruct_4 = Deconstruct(Point=graft_tree_16)  # -> XComponent, YComponent, ZComponent
vector_xyz = VectorXYZ(XComponent=number_slider_16, YComponent=Slider(0, range=-50..50), ZComponent=Slider(0, range=-50..50))  # -> Vector, Length
move_6 = Move(Geometry=list_item_18, Motion=vector_xyz.Vector)  # -> Geometry, Transform
construct_point_2 = ConstructPoint(XCoordinate=deconstruct_4.XComponent, YCoordinate=deconstruct_4.YComponent, ZCoordinate=deconstruct_3.ZComponent)
second_point = Data(construct_point_2)
unit_z_5 = UnitZ(Factor=1)
line_5 = Line(StartPoint=list_item_18, EndPoint=second_point)
flip_curve_2 = FlipCurve(Curve=line_5)  # -> Curve, Flag
xz_plane = XZPlane(Origin=second_point)
xy_plane = XYPlane(Origin=second_point)
construct_plane_2 = ConstructPlane(Origin=second_point, XAxis=flip_curve_2.Curve, YAxis=unit_z_5)
colour = Colour(colors_to_use_by_orig_function)
custom_preview = CustomPreview(Geometry=unflatten_tree_8, Material=colour)  # disabled

line_geometry_4 = Data(line_5)
line_thickness_4 = Data(Slider(0.22, range=0..2))
line_colors_4 = Data(colour)

panel_65 = Panel(line_colors_4)
rotate_axis = RotateAxis(Geometry=construct_plane_2, Angle=degrees("-90"), Axis=flip_curve_2.Curve)  # -> Geometry, Transform

text_tag_3d = TextTag3D(Location=rotate_axis.Geometry, Text=stream_filter_3, Size=1, Colour=colour, Justification=Slider(1, range=0..4))  # disabled

line_geometry_5 = Data(tree_item)
line_thickness_5 = Data(number_slider_13)
line_colors_5 = Data(colour)

boundary_surfaces = BoundarySurfaces(Edges=unflatten_tree_10)
custom_preview_2 = CustomPreview(Geometry=boundary_surfaces, Material=colour)
custom_preview_3 = CustomPreview(Geometry=cap_holes_5, Material=colour)

line_geometry_6 = Data(region_union_2)
line_thickness_6 = Data(Slider(0.62, range=0..2.5))
line_colors_6 = Data(ColourSwatch(SwatchColor=RGB(255, 255, 255)))

# ----
# Elefront organized baking
# Spheres
mesh_spheres = Data(unflatten_tree_7)
colors = Data(simplify(colour))
mesh_colours = MeshColours(Mesh=mesh_spheres, Colours=colors)

# ----
# Sphere connection lines
line_geometry_7 = Data(line_geometry_5)
line_colors_7 = Data(line_colors_5)

# ----
# Boundary line colors
colour_swatch_3 = ColourSwatch(SwatchColor=RGB(128, 128, 128))
line_colors_8 = Data(simplify(line_colors_5))
stream_filter_4 = StreamFilter(
    Gate=select_display_mode,
    Stream0=line_colors_8,
    Stream1=colour_swatch_3,
    Stream2=colour_swatch_3,
    Stream3=colour_swatch_3)

# ----
# Sort values from floors to divided functions
divided_indices_on_floors_2 = Data(entwine_4)
flatten_tree_13 = FlattenTree(Tree=divided_indices_on_floors_2, Path="{0}")
data_to_bake_organized_by_function = Data(entwine_8)

# ----
# Sort values from floors to main functions
indices_per_floor_3 = Data(indices_per_floor)
flatten_tree_14 = FlattenTree(Tree=indices_per_floor_3, Path="{0}")

# ----
# Geometry to bake
data_to_bake_partial_outlines_organized = Data(entwine_6)  # "Data to bake - partial outlines organized by floor"
data_to_bake_full_outlines_organized_by_2 = Data(data_to_bake_full_outlines_organized_by)  # "Data to bake - full outlines organized by floor"
organized_object_names_of_divided_functi = Data(entwine_7)  # "Organized object names of divided functions"
organized_object_names_of_full_functions_2 = Data(organized_object_names_of_full_functions)
organized_object_names_of_full_functions_3 = Data(organized_object_names_of_full_functions)
data_to_bake_organized_by_function_2 = Data(entwine_8)
colors_to_bake_organized_by_floor = Data(list_item_29)
organized_joined_layer_structure = Data(concatenate_6)
organized_dividedlayer_structure = Data(concatenate_5)

panel_66 = Panel(data_to_bake_full_outlines_organized_by_2)

# ----
# Preview colored functions
panel_67 = Panel("-1")
# ----
# Preview full colored functions
panel_68 = Panel("-1")

# ----
# Add text tags
panel_69 = Panel("1")
number_slider_17 = Slider(0.196, range=0..2)
colour_swatch_4 = ColourSwatch(SwatchColor=RGB(0, 0, 0))

# ----
# Add full text tags
panel_70 = Panel(": ")

# ----
# Names per corridor divided
panel_71 = Panel("Corridor_")

# ----
# Elefront organized baking
# Joined function outlines
# Floor joined outlines cluster bake
graft_tree_17 = GraftTree(Tree=colors_to_bake_organized_by_floor, IncludeEmptyLists=True, IncludeNullItems=True)
layer_name = Data(concatenate_7)
color = Data(graft_tree_17)
name = Data(organized_object_names_of_full_functions_2)

# ----
# Elefront organized baking
# Joined function
# Floor joined cluster bake
graft_tree_18 = GraftTree(Tree=colors_to_bake_organized_by_floor, IncludeEmptyLists=True, IncludeNullItems=True)
layer_name_2 = Data(organized_joined_layer_structure)
color_2 = Data(graft_tree_18)
name_2 = Data(organized_object_names_of_full_functions_2)
settings_custom = SettingsCustom(
    StitchSeams=True,
    SimplePlanes=Toggle(True),
    Refine=True,
    MinCount=16,
    MaxCount=400,
    AspectRatio=20,
    MaxDistance=0,
    MaxAngle=20,
    MinEdge=0,
    MaxEdge=0)

# ----
# Elefront organized baking
# divided function
graft_tree_19 = GraftTree(Tree=colors_to_bake_organized_by_floor, IncludeEmptyLists=True, IncludeNullItems=True)
layer_name_3 = Data(organized_dividedlayer_structure)
color_3 = Data(graft_tree_19)
name_3 = Data(organized_object_names_of_divided_functi)
panel_72 = Panel("Floor cluster bake")
settings_custom_2 = SettingsCustom(
    StitchSeams=True,
    SimplePlanes=Toggle(True),
    Refine=True,
    MinCount=16,
    MaxCount=400,
    AspectRatio=20,
    MaxDistance=0,
    MaxAngle=20,
    MinEdge=0,
    MaxEdge=0)

trim_tree_11 = TrimTree(Tree=graft_tree_19, Depth="1")

# ----
# Bake corridors to divided
colour_swatch_5 = ColourSwatch(SwatchColor=RGB(166, 166, 166))
layer_name_4 = Data(panel_52)
color_4 = Data(colour_swatch_5)
panel_73 = Panel("Corridors bake divided")
settings_custom_3 = SettingsCustom(
    StitchSeams=True,
    SimplePlanes=Toggle(True),
    Refine=True,
    MinCount=16,
    MaxCount=400,
    AspectRatio=20,
    MaxDistance=0,
    MaxAngle=20,
    MinEdge=0,
    MaxEdge=0)

# ----
# Bake corridors to joined
name_4 = Data(concatenate_9)
color_5 = Data(colour_swatch_5)
panel_74 = Panel("Corridors bake joined")

# ----
# Bake corridors outlines joined
# Corridors bake joined outlines
name_5 = Data(concatenate_8)
color_6 = Data(colour_swatch_5)

lab_region_function_per_floor = Data(list_item_36)
explode_4 = Explode(Curve=lab_region_function_per_floor, Recursive=True)  # -> Segments, Vertices

# ----
# Connection between functions per lab\hospital
list_item_45 = ListItem(List=list_item_40, Index=0, Wrap=True)  # -> Item, Item1

distance_5 = Distance(PointA=list_item_45.Item1, PointB=explode_4.Vertices)
sort_list_6 = SortList(Keys=distance_5, ValuesValuesA=explode_4.Vertices)  # -> Keys, ValuesValuesA
list_item_46 = ListItem(List=sort_list_6.ValuesValuesA, Index=0, Wrap=True)
trim_tree_12 = TrimTree(Tree=list_item_46, Depth="1")

line_6 = Line(StartPoint=list_item_45.Item, EndPoint=trim_tree_12)

shortest_walk = ShortestWalk(Curves=merge_18, WantedPath=line_6)  # -> ShortestWalk, Succession, Direction, Length
data_15 = Data(shortest_walk.ShortestWalk)
panel_75 = Panel(shortest_walk.ShortestWalk)

# ----
# Delete middle curves
explode_5 = Explode(Curve=shortest_walk.ShortestWalk, Recursive=True)  # -> Segments, Vertices
center_of_each_vertical = Data(list_item_40)
trim_tree_13 = TrimTree(Tree=explode_5.Segments, Depth="1")
removeduplicatelines_2 = RemoveDuplicateLines(Lines=trim_tree_13, Tolerance=0.01)
trim_tree_14 = TrimTree(Tree=removeduplicatelines_2, Depth="1")
list_item_47 = ListItem(List=center_of_each_vertical, Index=0, Wrap=True)  # -> Item, Item1
curve_closest_point = CurveClosestPoint(Point=list_item_47.Item, Curve=trim_tree_14)  # -> Point, Parameter, Distance
curve_closest_point_2 = CurveClosestPoint(Point=list_item_47.Item1, Curve=trim_tree_14)  # -> Point, Parameter, Distance
cull_distance = Panel("0.1")
ghpython_script_6 = GhPythonScript(x=curve_closest_point_2.Distance, z=curve_closest_point.Distance, y=cull_distance)  # -> out, a
# ---------- ghpython_script_6: Python ----------
import rhinoscriptsyntax as rs


if x > y and z > y:
    a = 1
else:
    a = 0
    
print y
# ---------- end ghpython_script_6 ----------
panel_76 = Panel(ghpython_script_6.a)
cull_pattern_2 = CullPattern(List=trim_tree_14, CullPattern=ghpython_script_6.a)

line_geometry_8 = Data(shortest_walk.ShortestWalk)
line_thickness_7 = Data(number_slider_9)
line_colors_9 = Data(ColourSwatch(SwatchColor=RGB(255, 0, 0)))

panel_77 = Panel(curve_closest_point.Distance)
paths_without_interior_curves = Data(cull_pattern_2)

# ----
# Delete curves from the V comm boundaries
# Quick python loop to search for the values
# Do it twice to ignore moment when
# there is exactly 1 line seperating v comms
region_of_each_vertical = Data(list_item_41)
list_item_48 = ListItem(List=region_of_each_vertical, Index=0, Wrap=True)  # -> Item, Item1
explode_6 = Explode(Curve=paths_without_interior_curves, Recursive=True)  # -> Segments, Vertices
explode_7 = Explode(Curve=list_item_48.Item, Recursive=True)  # -> Segments, Vertices
trim_tree_15 = TrimTree(Tree=explode_7.Vertices, Depth="1")
trim_tree_16 = TrimTree(Tree=explode_6.Segments, Depth="1")
cull_duplicates_3 = CullDuplicates(Points=trim_tree_15, Tolerance=0.1, CullMode=1)  # -> Points, Indices, Valence
removeduplicatelines_3 = RemoveDuplicateLines(Lines=trim_tree_16, Tolerance=0.01)
trim_tree_17 = TrimTree(Tree=cull_duplicates_3.Points, Depth="1")
trim_tree_18 = TrimTree(Tree=removeduplicatelines_3, Depth="1")
list_length_21 = ListLength(List=trim_tree_18)
duplicate_data_4 = DuplicateData(Data=trim_tree_17, Number=list_length_21, Order=True)
list_length_22 = ListLength(List=trim_tree_17)
graft_tree_20 = GraftTree(Tree=trim_tree_18, IncludeEmptyLists=True, IncludeNullItems=True)
boolean_toggle_6 = BooleanToggle(True)
partition_list = PartitionList(List=duplicate_data_4, Size=list_length_22)
path_mapper_8 = PathMapper(partition_list, source="{A;B;C;D}", target="{A;B;D}")
clean_tree_4 = CleanTree(RemoveNulls=boolean_toggle_6, RemoveInvalid=boolean_toggle_6, RemoveEmpty=boolean_toggle_6, Tree=path_mapper_8)
clean_tree_5 = CleanTree(RemoveNulls=boolean_toggle_6, RemoveInvalid=boolean_toggle_6, RemoveEmpty=boolean_toggle_6, Tree=graft_tree_20)
curve_closest_point_3 = CurveClosestPoint(Point=clean_tree_4, Curve=clean_tree_5)  # -> Point, Parameter, Distance
rounding_number = Panel("1e-10")
value_0 = Panel("0")
ghpython_script_7 = GhPythonScript(x=curve_closest_point_3.Distance, y=value_0, z=rounding_number)  # -> a; inputs x: list, y: Int32; same code as ghpython_script
trim_tree_19 = TrimTree(Tree=ghpython_script_7, Depth=1)
cull_pattern_3 = CullPattern(List=trim_tree_18, CullPattern=trim_tree_19)
paths_without_v_boundaries = Data(cull_pattern_3)

panel_78 = Panel(list_item_48.Item)
value_0_2 = Panel(cull_duplicates_3.Points)
value_0_3 = Panel(path_mapper_8)
param_viewer_4 = ParamViewer(trim_tree_17)
param_viewer_5 = ParamViewer(trim_tree_18)
param_viewer_6 = ParamViewer(path_mapper_8)
param_viewer_7 = ParamViewer(graft_tree_20)

# ----
# Delete curves smalle than
length_2 = Length(Curve=paths_without_v_boundaries)
delete_smaller_than = Panel("0.5")
ghpython_script_8 = GhPythonScript(x=length_2, y=delete_smaller_than)  # -> a
# ---------- ghpython_script_8: Python ----------
import rhinoscriptsyntax as rs


repeats_count = 0


if x < y:
    a = 0
else:
    a = 1
# ---------- end ghpython_script_8 ----------
cull_pattern_4 = CullPattern(List=paths_without_v_boundaries, CullPattern=ghpython_script_8)

data_16 = Data(cull_pattern_4)

line_geometry_9 = Data(data_16)
line_thickness_8 = Data(number_slider_10)
line_colors_10 = Data(ColourSwatch(SwatchColor=RGB(255, 0, 0)))

line_geometry_10 = Data(data_16)
line_thickness_9 = Data(Slider(0.53, range=0..2.5))
line_colors_11 = Data(colour_swatch_2)

explode_8 = Explode(Curve=data_16, Recursive=True)  # -> Segments, Vertices
trim_tree_20 = TrimTree(Tree=explode_8.Segments, Depth="1")
removeduplicatelines_4 = RemoveDuplicateLines(Lines=trim_tree_20, Tolerance=0.01)
trim_tree_21 = TrimTree(Tree=removeduplicatelines_4, Depth=1)
division_2 = Division(A=corridor_width, B="2")
panel_79 = Panel(division_2)
multipipe = MultiPipe(Curves=trim_tree_21, NodeSize=panel_79, EndOffset=1, StrutSize=1, Segment=0, KinkAngle=0.6, CubeFit=0)
cap_holes_6 = CapHoles(Brep=multipipe)

custom_preview_4 = CustomPreview(Geometry=multipipe, Material=colour_swatch_2)

list_item_49 = ListItem(List=area_7.Centroid, Index=0, Wrap=True)
planes = Data(list_item_49)
brep_plane = BrepPlane(Brep=cap_holes_6, Plane=planes)  # -> Curves, Points

multipipe_2 = MultiPipe(Curves=paths_without_v_boundaries, NodeSize=panel_79, EndOffset=1, StrutSize=1, Segment=0, KinkAngle=0.6, CubeFit=0)
data_17 = Data(multipipe_2)
tree_statistics_17 = TreeStatistics(Tree=data_17)  # -> Paths, Length, Count
value_from_multipipe = Panel(tree_branch)
list_item_50 = ListItem(List=tree_statistics_17.Paths, Index=value_from_multipipe, Wrap=True)
tree_branch_32 = TreeBranch(Tree=data_17, Path=list_item_50, MaintainPaths=True)
subd_control_polygon = SubDControlPolygon(SubD=tree_branch_32)
value_from_multipipe_2 = Panel(panel_79)
mesh_extend = MeshExtend(M=subd_control_polygon, L=1, U=True, N=Toggle(True), D=value_from_multipipe_2)  # -> out, A; inputs M: Mesh, D: list, clr: list of Color
# ---------- mesh_extend: VB ----------
    Component.Params.Input(0).Name = "Mesh"
    Component.Params.Input(0).Description = "Open or closed mesh"
    Component.Params.Input(1).Name = "Loops"
    Component.Params.Input(1).Description = "The number of successive edge extensions, default is 1"
    Component.Params.Input(2).Name = "Unitize"
    Component.Params.Input(2).Description = "If true the vectors which define the new edge offset direction will be unitized before being averaged"
    Component.Params.Input(3).Name = "Normalize Edges"
    Component.Params.Input(3).Description = "If true the vectors along a naked edge will be used to average the new offset direction"
    Component.Params.Input(4).Name = "Distance [Rh Units]"
    Component.Params.Input(4).Description = "An optional single number or list of numbers corresponding to each vertex of a mesh which sets the Rhino unit based distance that the new geometry is offset from each mesh face"
    Component.Params.Input(5).Name = "Color [Vertex]"
    Component.Params.Input(5).Description = "A an optional color or list of colors corresponding to each vertex mesh which colors the new edge"

    Component.Params.Output(1).Name = "Mesh"
    Component.Params.Output(1).Description = "If successful, a list of valid meshes"

    If M IsNot Nothing Then
      Dim la As Integer
      For la = 0 To (L - 1) Step 1
        Dim mo As New mesh
        Dim mv As Rhino.Geometry.Collections.MeshVertexList
        Dim mtv As Rhino.Geometry.Collections.MeshTopologyVertexList
        Dim mte As Rhino.Geometry.Collections.MeshTopologyEdgeList
        Dim mf As Rhino.Geometry.Collections.MeshFaceList
        Dim mc As Rhino.Geometry.Collections.MeshVertexColorList

        Dim i,j,k,ux As Integer
        Dim arrB() As Boolean
        Dim ov As New list(Of point3d)
        Dim ofc As New list(Of meshface)
        Dim nkd() As Integer
        Dim oc As New list(Of color)

        mv = M.Vertices
        mtv = M.TopologyVertices
        mte = M.TopologyEdges
        mf = m.Faces
        arrB = m.GetNakedEdgePointStatus
        mc = m.VertexColors

        ReDim nkd(mv.Count() - 1)

        If mv.count() > mte.Count() Then k = mv.Count() - 1 Else k = mte.Count() - 1

        Dim clrB As Boolean = False
        If ((m.VertexColors.count() > 0) Or (clr.count() > 0)) Then clrB = True
        If ((clr.count() > 0) And (m.VertexColors.count() = 0)) Then m.VertexColors.CreateMonotoneMesh(color.LightGray)

        k = mv.count()
        For i = 0 To mv.count() - 1 Step 1
          If arrB(i) Then
            Dim vec As New vector3d
            Dim arrV() As Integer
            Dim w, da As New Double

            arrV = mv.GetConnectedVertices(i)
            ux = 0

            For j = 0 To ubound(arrV) Step 1
              Dim blnV As Boolean = False
              If (N And (uBound(arrV) = 1)) Then
                blnV = True
              Else
                If arrB(arrV(j)) Then
                  If ubound(mte.GetConnectedFaces(mte.GetEdgeIndex(mtv.TopologyVertexIndex(i), mtv.TopologyVertexIndex(arrV(j))))) > 0 Then blnV = True
                Else
                  blnV = True
                End If

              End If

              If ((N And (blnV)) Or (N = False)) Then
                Dim vc As New vector3d()
                vc = New point3d(mv.item(i)) - New point3d(mv.item(arrV(j)))
                w += vc.Length
                If U Then vc.Unitize()
                ux += 1
                vec += vc
              End If
            Next

            If d.count() > 0 Then
              If (d.count() - 1) < i Then da = d.item(d.count() - 1) Else da = d.item(i)
              vec.Unitize()
              vec *= da
            Else
              If U Then
                vec.Unitize()
                vec *= (w / (uBound(arrV) + 1))
              End If
            End If
            ov.add(New point3d(mv.item(i)) + vec)
            If clrB Then
              If la = 0 Then
                If (clr.count() > 0) Then If i > (clr.count() - 1) Then oc.add(clr.item(clr.count() - 1)) Else oc.add(clr.item(i)) Else oc.add(mc.item(i))
              Else
                oc.add(mc.item(i))
              End If
            End If
            nkd(i) = k
            K += 1
          End If
        Next

        For i = 0 To mte.count() - 1 Step 1
          If ubound(mte.GetConnectedFaces(i)) < 1 Then
            Dim Ua,V As Integer
            Ua = mtv.MeshVertexIndices(mte.GetTopologyVertices(i).I)(0)
            V = mtv.MeshVertexIndices(mte.GetTopologyVertices(i).J)(0)
            ofc.add(New meshface(Ua, nkd(Ua), nkd(V), V))
          End If
        Next

        mo.Vertices.AddVertices(mv)
        mo.Faces.AddFaces(mf)
        mo.Vertices.AddVertices(ov)
        If clrB Then mo.VertexColors.AppendColors(mc.toarray())
        If clrB Then mo.VertexColors.AppendColors(oc.toarray())
        mo.Faces.AddFaces(ofc)
        mo.UnifyNormals()
        mo.Normals.ComputeNormals()

        m = mo
      Next
      A = m
    End If
# ---------- end mesh_extend ----------
mesh_caps = MeshCaps(M=mesh_extend.A, W=True, O=Toggle(True), D=0)  # -> out, A, E; inputs M: Mesh, clr: Color
# ---------- mesh_caps: VB ----------
    Component.Params.Input(0).Name = "Mesh"
    Component.Params.Input(0).Description = "An open mesh"
    Component.Params.Input(1).Name = "Join and Weld"
    Component.Params.Input(1).Description = "If true the original mesh will be joined and welded to the new caps, else the caps will be output as a list of new meshes"
    Component.Params.Input(2).Name = "Simplify Faces"
    Component.Params.Input(2).Description = "If true, naked edges consisting of 3 to 4 segments will be replaced with a single face, else faces will use new center vertex method"
    Component.Params.Input(3).Name = "Distance (Optional, Rhino Units)"
    Component.Params.Input(3).Description = "A single number which sets the Rhino unit based distance that the center point will be offset from the vertex averages"

    Component.Params.Output(1).Name = "Mesh"
    Component.Params.Output(1).Description = "If successful, a list or single of valid meshes"
    Component.Params.Output(2).Name = "Polylines"
    Component.Params.Output(2).Description = "If successful, a list of valid edge polylines"

    If M IsNot Nothing Then
      Dim i,j,k,kk,ka As Integer
      Dim arrP() As polyline
      Dim P As polyline
      Dim arrM As New list(Of Mesh)
      Dim mj As New mesh
      Dim clrB,clrC,blnN() As Boolean
      Dim oc,tcc As New list(Of color)
      If (clr <> Nothing) Then clrC = True
      If ((m.VertexColors.count() > 0) Or (clr <> Nothing)) Then clrB = True
      If (m.VertexColors.count() = 0) Then  m.vertexcolors.CreateMonotoneMesh(color.LightGray)
      oc = m.VertexColors.ToArray.tolist()
      Dim mv() As point3d
      Dim mo As New list(Of mesh)
      Dim fc As New list(Of MeshFace)
      Dim np As New list(Of point3d)
      Dim ni As New list(Of Integer)
      Dim ind(3) As Integer

      mv = m.Vertices.ToPoint3dArray()
      blnN = m.GetNakedEdgePointStatus()
      arrP = m.GetNakedEdges()

      For i = 0 To ubound(blnN) Step 1
        If blnN(i) Then
          np.add(mv(i))
          ni.add(i)
        End If
      Next

      Dim cld As New pointcloud(np.toarray())
      For i = 0 To ubound(arrP) Step 1
        Dim tm As New mesh
        tm.Vertices.Clear()
        tm.Faces.Clear()

        p = arrP(i)
        If (O And (p.count() < 6)) Then
          ind(0) = ni(cld.ClosestPoint(p(0)))
          ind(1) = ni(cld.ClosestPoint(p(1)))
          ind(2) = ni(cld.ClosestPoint(p(2)))
          ind(3) = ni(cld.ClosestPoint(p(3)))
          tm.Vertices.Add(mv(ind(0)))
          tm.Vertices.Add(mv(ind(1)))
          tm.Vertices.Add(mv(ind(2)))

          tm.VertexColors.Add(oc(ind(0)))
          tm.VertexColors.Add(oc(ind(1)))
          tm.VertexColors.Add(oc(ind(2)))
          If p.count() = 5 Then
            fc.add(New meshface(ind(0), ind(1), ind(2), ind(3)))
            tm.Vertices.Add(mv(ind(3)))
            tm.VertexColors.Add(oc(ind(3)))
            tm.Faces.addface(New meshface(0, 1, 2, 3))
          ElseIf p.count() = 4 Then
            fc.add(New meshface(ind(0), ind(1), ind(2)))
            tm.Faces.addface(New meshface(0, 1, 2))
          End If
          tm.FaceNormals.ComputeFaceNormals()
          tm.Normals.ComputeNormals()
          mo.add(tm)

        Else
          Dim tx As New mesh
          Dim vec As New vector3d
          Dim tv As New list(Of point3d)
          Dim tc As New list(Of color)
          Dim tfc As New list(Of meshface)
          Dim r,g,b As Integer
          Dim tcl As color
          k = cld.ClosestPoint(p(0))
          ka = k
          tx.Vertices.AddVertices(p.ToArray())
          tx.Faces.AddFaces(p.TriangulateClosedPolyline())
          tx.Normals.ComputeNormals()

          vec = tx.Normals(0)

          tv.add(p(0))
          tc.add(oc(k))
          r = oc(ni(k)).R
          g = oc(ni(k)).G
          b = oc(ni(k)).B
          For j = 1 To p.count() - 2 Step 1
            kk = cld.ClosestPoint(p(j))
            fc.add(New meshface(m.Vertices.count(), ni(k), ni(kk)))
            vec += tx.Normals(j)
            k = kk

            tv.add(p(j))
            tc.add(oc(k))
            r += oc(ni(k)).R
            g += oc(ni(k)).G
            b += oc(ni(k)).B
            tfc.add(New meshface(p.count() - 1, j - 1, j))
          Next
          fc.add(New meshface(m.Vertices.count(), ni(k), ni(ka)))
          vec.Unitize()
          vec *= D
          m.Vertices.add(p.CenterPoint() + vec)

          r /= (p.count() - 1)
          g /= (p.count() - 1)
          b /= (p.count() - 1)
          If r > 255 Then r = 255 Else If r < 0 Then r = 0
          If g > 255 Then g = 255 Else If g < 0 Then g = 0
          If b > 255 Then b = 255 Else If b < 0 Then b = 0
          If clrC Then tcl = clr Else tcl = color.FromArgb(r, g, b)
          m.VertexColors.Add(tcl)

          tv.add(p.CenterPoint() + vec)
          tc.add(tcl)
          tfc.add(New meshface(p.count() - 1, p.count() - 2, 0))
          tm.vertices.AddVertices(tv.toarray())
          If clrB Then tm.VertexColors.AppendColors(tc.toarray())
          tm.faces.addfaces(tfc)
          tm.FaceNormals.ComputeFaceNormals()
          tm.Normals.ComputeNormals()
          mo.add(tm)
        End If
      Next

      If w Then
        m.Faces.AddFaces(fc)
        m.FaceNormals.ComputeFaceNormals()
        m.UnifyNormals()
        m.Normals.ComputeNormals()
        If Not clrB Then m.VertexColors.Clear()
        A = m
      Else
        A = mo
      End If
      E = arrP
    End If
# ---------- mesh_caps: VB additional code ----------
  Private Function avgC(ByVal R As Double, ByVal G As Double, ByVal B As Double, ByVal T As Integer)

    R /= t
    G /= t
    B /= t
    If R > 255 Then R = 255 Else If R < 0 Then R = 0
    If G > 255 Then G = 255 Else If G < 0 Then G = 0
    If B > 255 Then B = 255 Else If B < 0 Then B = 0

    Return color.FromArgb(CInt(R), CInt(G), CInt(B))
  End Function
# ---------- end mesh_caps ----------
data_18 = Data(shortest_walk.ShortestWalk)
tree_statistics_18 = TreeStatistics(Tree=data_18)  # -> Paths, Length, Count
data_19 = Data(mesh_caps.A)
subd_from_mesh = SubDFromMesh(Mesh=data_19, Creases=1, Corners=1, Interpolate=False)
data_20 = Data(planes)
list_item_51 = ListItem(List=tree_statistics_18.Paths, Index=value_from_multipipe, Wrap=True)
tree_statistics_19 = TreeStatistics(Tree=data_20)  # -> Paths, Length, Count
tree_branch_33 = TreeBranch(Tree=data_18, Path=list_item_51, MaintainPaths=True)
list_item_52 = ListItem(List=tree_statistics_19.Paths, Index=value_from_multipipe, Wrap=True)
tree_branch_34 = TreeBranch(Tree=data_20, Path=list_item_52, MaintainPaths=True)
brep_plane_2 = BrepPlane(Brep=subd_from_mesh, Plane=tree_branch_34)  # -> Curves, Points
merge_20 = Merge(Data1=brep_plane_2.Curves, Data2=tree_branch_33)

line_geometry_11 = Data(brep_plane_2.Curves)
line_thickness_10 = Data(Slider(0.32, range=0..2.5))
line_colors_12 = Data(ColourSwatch(SwatchColor=RGB(255, 255, 255)))

line_geometry_12 = Data(tree_branch_33)
line_thickness_11 = Data(Slider(0.53, range=0..2.5))
line_colors_13 = Data(ColourSwatch(SwatchColor=RGB(199, 183, 183)))

subd_control_polygon_2 = SubDControlPolygon(SubD=multipipe)
value_from_multipipe_3 = Panel(panel_79)
mesh_extend_2 = MeshExtend(M=subd_control_polygon_2, L=1, U=True, N=Toggle(True), D=value_from_multipipe_3)  # -> out, A; inputs M: Mesh, D: list, clr: list of Color; same code as mesh_extend
mesh_caps_2 = MeshCaps(M=mesh_extend_2.A, W=True, O=Toggle(True), D=0)  # -> out, A, E; inputs M: Mesh, clr: Color; same code as mesh_caps
data_21 = Data(mesh_caps_2.A)
subd_from_mesh_2 = SubDFromMesh(Mesh=data_21, Creases=1, Corners=1, Interpolate=False)
brep_plane_3 = BrepPlane(Brep=subd_from_mesh_2, Plane=planes)  # -> Curves, Points

pipe_corridors = Data(subd_from_mesh_2)
trim_tree_22 = TrimTree(Tree=pipe_corridors, Depth="1")

# ----
# Show one floor
pipe_corridors_2 = Data(trim_tree_22)
current_floor = Panel(tree_branch)
list_item_53 = ListItem(List=pipe_corridors_2, Index=current_floor, Wrap=True)
colour_swatch_6 = ColourSwatch(SwatchColor=RGB(120, 120, 120))
subd_edges = SubDEdges(SubD=list_item_53, NewFormatting=False)  # -> Line, Edge, Tag, Id

concatenate_11 = Concatenate(Fragment_A="{0;", Fragment_B=current_floor, A="}")
panel_80 = Panel(concatenate_11)
panel_81 = Panel(current_floor)

line_geometry_13 = Data(subd_edges.Edge)
line_thickness_12 = Data(Slider(0.1, range=0..2))
line_colors_14 = Data(ColourSwatch(SwatchColor=RGB(255, 255, 255)))

line_thickness_13 = Data(Slider(0.2, range=0..2))
line_colors_15 = Data(colour_swatch)

line_thickness_14 = Data("0.2")
line_colors_16 = Data(colour_swatch)

# ----
# Create text tags
panel_82 = Panel("0.1")
unit_z_6 = UnitZ(Factor=panel_82)

# ----
# Edge geometry(lines)
line_geometry_14 = Data(line_geometry_5)

# ----
# Geometry(meshes)
mesh_spheres_2 = Data(mesh_colours)

# ----
# Dimensions
number_slider_18 = Slider(0.451, range=0..1.2)
value_list_2 = ValueList({"Default", "Millimeter Architectural", "Millimeter Large", "Millimeter Small"}, selected="Millimeter Small")

# ----
# Multipie from lines
panel_83 = Panel("0.1")

line_thickness_15 = Data("0.05")
line_colors_17 = Data(ColourSwatch(SwatchColor=RGB(255, 255, 255)))

brep_edges_3 = BrepEdges(Brep=multipipe)  # -> Naked, Interior, NonManifold
data_22 = Data(brep_edges_3.Naked)
construct_point_3 = ConstructPoint(XCoordinate="0.5", YCoordinate="0.5", ZCoordinate=0)

clean_tree_6 = CleanTree(RemoveNulls=True, RemoveInvalid=True, RemoveEmpty=boolean_toggle_3, Tree=data_22)

join_curves_3 = JoinCurves(Curves=clean_tree_6, Preserve=False)
boundary_surfaces_2 = BoundarySurfaces(Edges=join_curves_3)
evaluate_surface = EvaluateSurface(Surface=reparameterize(boundary_surfaces_2), Point=construct_point_3)  # -> Point, Normal, UDirection, VDirection, Frame
area_8 = Area(Geometry=join_curves_3)  # -> Area, Centroid
rotate_3d = Rotate3D(Geometry=join_curves_3, Angle=degrees("90"), Center=area_8.Centroid, Axis=evaluate_surface.UDirection)  # -> Geometry, Transform
trim_tree_23 = TrimTree(Tree=rotate_3d.Geometry, Depth="1")
merge_21 = Merge(Data1=trim_tree_23, Data2=brep_plane.Curves)
project = Project(Geometry=merge_21, Plane=planes)  # -> Geometry, Transform
trim_tree_24 = TrimTree(Tree=project.Geometry, Depth=1)
region_union_3 = RegionUnion(Curves=trim_tree_24, Plane=planes)

clean_tree_7 = CleanTree(RemoveNulls=True, RemoveInvalid=True, RemoveEmpty=boolean_toggle_3, Tree=data_22)
panel_84 = Panel(clean_tree_6)
curve_to_polyline = CurveToPolyline(Curve=region_union_3, ToleranceDistance=0, ToleranceAngle=0, MaxEdge=Slider(0.2, range=0..1))  # -> Polyline, Segments
panel_85 = Panel(region_union_3)

# ----
# Subtract corridors from divided functions clusters
data_to_bake_partial_outlines_organized_2 = Data(entwine_6)  # "Data to bake - partial outlines organized by floor"
trim_tree_25 = TrimTree(Tree=data_to_bake_partial_outlines_organized_2, Depth="1")
trim_tree_26 = TrimTree(Tree=region_union_3, Depth="1")
region_difference = RegionDifference(CurvesA=trim_tree_25, CurvesB=trim_tree_26, Plane=planes)
trim_tree_27 = TrimTree(Tree=region_difference, Depth="1")
flatten_tree_15 = FlattenTree(Tree=region_difference, Path="{0}")
unflatten_tree_15 = UnflattenTree(Tree=flatten_tree_15, Guide=data_to_bake_partial_outlines_organized_2)
subtracted_partial_functions = Data(unflatten_tree_15)

# ----
# Subtract corridors from merged functions clusters no subtraction from lifts
panel_86 = Panel("1")
trim_tree_28 = TrimTree(Tree=cull_index_4, Depth=panel_86)
trim_tree_29 = TrimTree(Tree=region_union_3, Depth="1")
trim_tree_30 = TrimTree(Tree=brep_plane_3.Curves, Depth="1")
v_comm_indices = Data(lift_index_per_floor)
v_comm = Data(list_item_41)
region_difference_2 = RegionDifference(CurvesA=trim_tree_28, CurvesB=trim_tree_29, Plane=planes)
trim_tree_31 = TrimTree(Tree=region_difference_2, Depth="1")
list_item_54 = ListItem(List=v_comm, Index=0, Wrap=True)  # -> Item, Item1
boolean_toggle_7 = BooleanToggle(False)
list_item_55 = ListItem(List=v_comm_indices, Index=0, Wrap=True)  # -> Item, Item1
insert_items = InsertItems(List=trim_tree_31, Item=list_item_54.Item, Indices=list_item_55.Item, Wrap=boolean_toggle_7)
insert_items_2 = InsertItems(List=insert_items, Item=list_item_54.Item1, Indices=list_item_55.Item1, Wrap=boolean_toggle_7)
trim_tree_32 = TrimTree(Tree=insert_items, Depth="1")
subtracted_functions = Data(trim_tree_32)

# ----
# Corridors per floor
panel_87 = Panel("1")
trim_tree_33 = TrimTree(Tree=region_union_3, Depth=panel_87)
corridors_per_floor = Data(trim_tree_33)

corridors_per_floor_2 = Data(corridors_per_floor)
boundary_surfaces_3 = BoundarySurfaces(Edges=corridors_per_floor_2)

clean_tree_8 = CleanTree(RemoveNulls=True, RemoveInvalid=True, RemoveEmpty=Toggle(True), Tree=corridors_per_floor_2)
panel_88 = Panel(v_comm_indices)
panel_89 = Panel(list_item_54.Item)

# ----
# Corridor floors massings
planes_per_floor_5 = Data(planes_per_floor)
point_6 = Point(flatten(planes_per_floor_5))
list_item_56 = ListItem(List=point_6, Index=0, Wrap=True)  # -> Item, Item1
distance_6 = Distance(PointA=list_item_56.Item, PointB=list_item_56.Item1)
unit_z_7 = UnitZ(Factor=distance_6)
move_7 = Move(Geometry=corridors_per_floor, Motion=expr("-x/2", unit_z_7))  # -> Geometry, Transform
extrude_8 = Extrude(Base=move_7.Geometry, Direction=unit_z_7)
cap_holes_7 = CapHoles(Brep=extrude_8)
corridors_massings_per_floor = Data(cap_holes_7)

# ----
# Divided floors massings
planes_per_floor_6 = Data(planes_per_floor)
point_7 = Point(flatten(planes_per_floor_6))
list_item_57 = ListItem(List=point_7, Index=0, Wrap=True)  # -> Item, Item1
distance_7 = Distance(PointA=list_item_57.Item, PointB=list_item_57.Item1)
unit_z_8 = UnitZ(Factor=distance_7)
move_8 = Move(Geometry=subtracted_partial_functions, Motion=expr("-x/2", unit_z_8))  # -> Geometry, Transform
extrude_9 = Extrude(Base=move_8.Geometry, Direction=unit_z_8)
cap_holes_8 = CapHoles(Brep=extrude_9)
divided_floor_massings = Data(cap_holes_8)

divided_floor_massings_by_floor = Data(divided_floor_massings)
flatten_tree_16 = FlattenTree(Tree=divided_floor_massings_by_floor, Path="{0}")
sort_list_7 = SortList(Keys=flatten_tree_13, ValuesB=flatten_tree_16)  # -> Keys, ValuesB
unflatten_tree_16 = UnflattenTree(Tree=sort_list_7.ValuesB, Guide=data_to_bake_organized_by_function)
divided_floor_massings_by_function = Data(unflatten_tree_16)

panel_90 = Panel(divided_floor_massings)

divided_floor_massings_by_function_2 = Data(divided_floor_massings_by_function)
divided_floor_massings_by_floor_2 = Data(divided_floor_massings)
corridors_massings_per_floor_2 = Data(corridors_massings_per_floor)
subtracted_partial_functions_2 = Data(subtracted_partial_functions)
corridors_outlines_per_floor = Data(corridors_per_floor)
stream_filter_5 = StreamFilter(Gate=pick_type_2, Stream0=data_to_bake_partial_outlines_organized, Stream1=subtracted_partial_functions_2)
divided_function = Data(stream_filter_5)

flatten_tree_17 = FlattenTree(Tree=corridors_outlines_per_floor, Path="{0}")
indices_7 = ListIndices(list=flatten_tree_17)
unflatten_tree_17 = UnflattenTree(Tree=indices_7, Guide=corridors_outlines_per_floor)
concatenate_12 = Concatenate(FragmentA=panel_71, FragmentB=unflatten_tree_17)

deconstruct_brep_3 = DeconstructBrep(Brep=divided_function)  # -> Faces, Edges, Vertices
list_item_58 = ListItem(List=deconstruct_brep_3.Faces, Index=panel_67, Wrap=True)
trim_tree_34 = TrimTree(Tree=list_item_58, Depth="1")
custom_preview_5 = CustomPreview(Geometry=trim_tree_34, Material=graft_tree_19)

area_9 = Area(Geometry=list_item_58)  # -> Area, Centroid
trim_tree_35 = TrimTree(Tree=area_9.Centroid, Depth=panel_69)
trim_tree_36 = TrimTree(Tree=area_9.Area, Depth=panel_69)
ghpython_script_9 = GhPythonScript(x=trim_tree_36)  # -> out, a
# ---------- ghpython_script_9: Python ----------
__author__ = "solty"
__version__ = "2021.03.07"

import rhinoscriptsyntax as rs

a = round( x , 1 )
print a
print x
# ---------- end ghpython_script_9 ----------
concatenate_13 = Concatenate(FragmentA=organized_object_names_of_divided_functi, FragmentA_2=": ", FragmentB=ghpython_script_9.a, FragmentB_2="m2")
xy_plane_2 = XYPlane(Origin=trim_tree_35)
text_tag_3d_2 = TextTag3D(Location=xy_plane_2, Text=concatenate_13, Size=number_slider_17, Colour=colour_swatch_4, Justification="5")

geometry = Data(divided_floor_massings_by_floor_2)
brep_edges_4 = BrepEdges(Brep=geometry)  # -> Naked, Interior, NonManifold
trim_tree_37 = TrimTree(Tree=brep_edges_4.Interior, Depth="1")
mesh_brep = MeshBrep(Brep=geometry, Settings=settings_custom_2)
mesh_colours_2 = MeshColours(Mesh=mesh_brep, Colours=color_3)

geometry_2 = Data(corridors_massings_per_floor_2)

geometry_3 = Data(corridors_massings_per_floor_2)
name_6 = Data(concatenate_12)
brep_edges_5 = BrepEdges(Brep=geometry_3)  # -> Naked, Interior, NonManifold
trim_tree_38 = TrimTree(Tree=brep_edges_5.Interior, Depth="1")
mesh_brep_2 = MeshBrep(Brep=geometry_3, Settings=settings_custom_3)
mesh_colours_3 = MeshColours(Mesh=mesh_brep_2, Colours=color_4)

geometry_4 = Data(corridors_outlines_per_floor)

list_length_23 = ListLength(List=trim_tree_34)
duplicate_data_5 = DuplicateData(Data=graft_tree_19, Number=list_length_23, Order=True)
trim_tree_39 = TrimTree(Tree=duplicate_data_5, Depth="2")

stream_filter_6 = StreamFilter(Gate=pick_gate, Stream0=trim_tree_39, Stream1=trim_tree_11)

corridors_per_floor_surface = Data(boundary_surfaces_3)
material = Data(stream_filter_6)
tree_statistics_20 = TreeStatistics(Tree=material)  # -> Paths, Length, Count
tree_statistics_21 = TreeStatistics(Tree=corridors_per_floor_surface)  # -> Paths, Length, Count
list_item_59 = ListItem(List=tree_statistics_21.Paths, Index=current_floor, Wrap=invert(True))
list_item_60 = ListItem(List=tree_statistics_20.Paths, Index=current_floor, Wrap=True)
tree_branch_35 = TreeBranch(Tree=material, Path=list_item_60, MaintainPaths=True)
tree_branch_36 = TreeBranch(Tree=corridors_per_floor_surface, Path=list_item_59, MaintainPaths=True)
brep_edges_6 = BrepEdges(Brep=tree_branch_36)  # -> Naked, Interior, NonManifold

line_geometry_15 = Data(brep_edges_6.Naked)

# ----
# Color mesh corridors
mesh_brep_3 = MeshBrep(
    Brep=tree_branch_36,
    Settings={GridMaxCount=0, GridMinCount=16, JaggedSeams=False, MaxEdgeLength=0, MinEdgeLength=0.0001, MinTolerance=0, Refine=True, RefineAngle=0, RelativeTolerance=0.65, SimplePlanes=True, Tolerance=0})
mesh_colours_4 = MeshColours(Mesh=mesh_brep_3, Colours=colour_swatch_6)

custom_preview_6 = CustomPreview(Geometry=tree_branch_36, Material=colour_swatch_6)

mesh_divided_corridors = Data(mesh_colours_3)

mesh_divided_function = Data(mesh_colours_2)

divided_function_edges = Data(trim_tree_37)

# ----
# Edge geometry(just lines)
edges_corridors = Data(trim_tree_38)
stream_filter_7 = StreamFilter(Gate=select_display_mode, Stream1=edges_corridors, Stream2=edges_corridors)

# ----
# Color mesh
colors_2 = Data(tree_branch_35)

function_corridor_mesh = Mesh(mesh_colours_4)
function_corridor_line = Geometry(line_geometry_15)

function_corridor_mesh_2 = Mesh(function_corridor_mesh)
stream_filter_8 = StreamFilter(
    Gate=select_display_mode,
    Stream1=mesh_divided_corridors,
    Stream2=mesh_divided_corridors,
    Stream3=function_corridor_mesh_2)

function_corridor_line_2 = Geometry(function_corridor_line)

stream_filter_9 = StreamFilter(Gate=select_display_mode, Stream0=line_geometry_14, Stream3=function_corridor_line_2)

# ----
# Subtract corridors from merged functions clusters with subtraction from lifts
panel_91 = Panel("1")
trim_tree_40 = TrimTree(Tree=cull_index_4, Depth=panel_91)
trim_tree_41 = TrimTree(Tree=region_union_3, Depth="1")
trim_tree_42 = TrimTree(Tree=brep_plane_3.Curves, Depth="1")
v_comm_indices_2 = Data(lift_index_per_floor)
v_comm_2 = Data(list_item_41)
list_item_61 = ListItem(List=v_comm_2, Index=0, Wrap=True)  # -> Item, Item1
list_item_62 = ListItem(List=v_comm_indices_2, Index=0, Wrap=True)  # -> Item, Item1
insert_items_3 = InsertItems(List=trim_tree_40, Item=list_item_61.Item, Indices=list_item_62.Item, Wrap=Toggle(False))
trim_tree_43 = TrimTree(Tree=insert_items_3, Depth="1")

region_difference_3 = RegionDifference(CurvesA=trim_tree_43, CurvesB=trim_tree_41, Plane=planes)
trim_tree_44 = TrimTree(Tree=region_difference_3, Depth="1")

subtracted_functions_2 = Data(trim_tree_44)

# ----
# Full floors massings
planes_per_floor_7 = Data(planes_per_floor)
point_8 = Point(flatten(planes_per_floor_7))
list_item_63 = ListItem(List=point_8, Index=0, Wrap=True)  # -> Item, Item1
distance_8 = Distance(PointA=list_item_63.Item, PointB=list_item_63.Item1)
unit_z_9 = UnitZ(Factor=distance_8)
move_9 = Move(Geometry=subtracted_functions_2, Motion=expr("-x/2", unit_z_9))  # -> Geometry, Transform
extrude_10 = Extrude(Base=move_9.Geometry, Direction=unit_z_9)
cap_holes_9 = CapHoles(Brep=extrude_10)
joined_floor_massings = Data(cap_holes_9)

joined_floor_massings_by_floor = Data(joined_floor_massings)
subtracted_functions_3 = Data(subtracted_functions_2)
flatten_tree_18 = FlattenTree(Tree=subtracted_functions_3, Path="{0}")
flatten_tree_19 = FlattenTree(Tree=joined_floor_massings_by_floor, Path="{0}")
sort_list_8 = SortList(Keys=flatten_tree_14, ValuesValuesA=flatten_tree_18, ValuesA=flatten_tree_19)  # -> Keys, ValuesValuesA, ValuesA, ValuesB
joined_floor_massings_by_function = Data(sort_list_8.ValuesA)
area_10 = Area(Geometry=sort_list_8.ValuesValuesA)  # -> Area, Centroid
subtracted_corridor_area = Data(area_10.Area)

# ----
# Floor distribution
# Reset SOLVER
subtracted_corridor_area_2 = Data(subtracted_corridor_area)
actual_area_per_shpere_with_subtracted_c = Panel(subtracted_corridor_area_2)  # "Actual area per shpere with subtracted corridor"

division_3 = Division(A=actual_area_per_shpere_with_subtracted_c, B=areas)
multiplication_9 = Multiplication(A=division_3, B=100)
ghpython_script_10 = GhPythonScript(x=multiplication_9)  # -> out, a
# ---------- ghpython_script_10: Python ----------
a = round(x, 1)
# ---------- end ghpython_script_10 ----------
concatenate_14 = Concatenate(FragmentA=ghpython_script_10.a, FragmentB=" %")

areas_5 = Panel(concatenate_14)
average = Average(Input=ghpython_script_10.a)
average_2 = Panel(average)

average_of_desired_area_achieved = Panel(average_2)

joined_floor_massings_by_function_2 = Data(joined_floor_massings_by_function)
joined_floor_massings_by_floor_2 = Data(joined_floor_massings)
subtracted_functions_4 = Data(subtracted_functions_2)
stream_filter_10 = StreamFilter(Gate=pick_type_2, Stream0=data_to_bake_full_outlines_organized_by_2, Stream1=subtracted_functions_4)
merged_function = Data(stream_filter_10)

deconstruct_brep_4 = DeconstructBrep(Brep=merged_function)  # -> Faces, Edges, Vertices
list_item_64 = ListItem(List=deconstruct_brep_4.Faces, Index=panel_68, Wrap=True)
custom_preview_7 = CustomPreview(Geometry=list_item_64, Material=graft_tree_19)

area_11 = Area(Geometry=list_item_64)  # -> Area, Centroid
ghpython_script_11 = GhPythonScript(x=area_11.Area)  # -> out, a; same code as ghpython_script_9
concatenate_15 = Concatenate(
    FragmentA=organized_object_names_of_full_functions_3,
    FragmentA_2=panel_70,
    FragmentB=ghpython_script_11.a,
    FragmentB_2="m2")
xy_plane_3 = XYPlane(Origin=area_11.Centroid)
text_tag_3d_3 = TextTag3D(
    Location=xy_plane_3,
    Text=concatenate_15,
    Size=Slider(0.307, range=0..2),
    Colour=ColourSwatch(SwatchColor=RGB(0, 0, 0)),
    Justification="5")

custom_preview_8 = CustomPreview(Geometry=joined_floor_massings_by_function, Material=ColourSwatch(SwatchColor=RGB(189, 134, 134)))  # disabled
subtracted_functions_5 = Data(subtracted_functions_4)

graft_tree_21 = GraftTree(Tree=joined_floor_massings_by_floor_2, IncludeEmptyLists=True, IncludeNullItems=True)  # -> simplify(Tree)
geometry_5 = Data(graft_tree_21)
brep_edges_7 = BrepEdges(Brep=geometry_5)  # -> Naked, Interior, NonManifold
trim_tree_45 = TrimTree(Tree=brep_edges_7.Interior, Depth="1")
mesh_brep_4 = MeshBrep(Brep=geometry_5, Settings=settings_custom)
mesh_colours_5 = MeshColours(Mesh=mesh_brep_4, Colours=color_2)

graft_tree_22 = GraftTree(Tree=subtracted_functions_5, IncludeEmptyLists=True, IncludeNullItems=True)  # -> simplify(Tree)
geometry_6 = Data(graft_tree_22)

stream_filter_11 = StreamFilter(Gate=pick_gate, Stream0=trim_tree_34, Stream1=list_item_64)
stream_filter_12 = StreamFilter(Gate=pick_gate, Stream0=concatenate_13, Stream1=concatenate_15)
stream_filter_13 = StreamFilter(Gate=pick_gate, Stream0=xy_plane_2, Stream1=xy_plane_3)

trim_tree_46 = TrimTree(Tree=stream_filter_11, Depth="1")
trim_tree_47 = TrimTree(Tree=stream_filter_12, Depth="1")
trim_tree_48 = TrimTree(Tree=stream_filter_13, Depth="1")

geometry_7 = Data(trim_tree_46)
text = Data(trim_tree_47)
location = Data(trim_tree_48)
tree_statistics_22 = TreeStatistics(Tree=location)  # -> Paths, Length, Count
tree_statistics_23 = TreeStatistics(Tree=text)  # -> Paths, Length, Count
tree_statistics_24 = TreeStatistics(Tree=geometry_7)  # -> Paths, Length, Count
list_item_65 = ListItem(List=tree_statistics_22.Paths, Index=current_floor, Wrap=True)
list_item_66 = ListItem(List=tree_statistics_23.Paths, Index=current_floor, Wrap=True)
list_item_67 = ListItem(List=tree_statistics_24.Paths, Index=current_floor, Wrap=True)
tree_branch_37 = TreeBranch(Tree=geometry_7, Path=list_item_67, MaintainPaths=True)
tree_branch_38 = TreeBranch(Tree=text, Path=list_item_66, MaintainPaths=True)
tree_branch_39 = TreeBranch(Tree=location, Path=list_item_65, MaintainPaths=True)

brep_edges_8 = BrepEdges(Brep=tree_branch_37)  # -> Naked, Interior, NonManifold
trim_tree_49 = TrimTree(Tree=brep_edges_8.Naked, Depth="1")

text_tag_3d_4 = TextTag3D(Location=tree_branch_39, Text=tree_branch_38, Size=number_slider_17, Colour=colour_swatch_4, Justification="5")
custom_preview_9 = CustomPreview(Geometry=tree_branch_37, Material=tree_branch_35)

bounding_box_7 = BoundingBox(Content=trim_tree_49, Plane=PlaneXY(0, 0, 0), UnionBox=True)  # -> Box, Box_2
brep_edges_9 = BrepEdges(Brep=bounding_box_7.Box)  # -> Naked, Interior, NonManifold
join_curves_4 = JoinCurves(Curves=brep_edges_9.Naked, Preserve=False)
explode_9 = Explode(Curve=join_curves_4, Recursive=True)  # -> Segments, Vertices
list_item_68 = ListItem(List=explode_9.Vertices, Index=0, Wrap=True)  # -> Item, Item1, Item2, Item3
aligned_dimension = AlignedDimension(
    Plane=PlaneXY(0, 0, 0),
    PointA=list_item_68.Item2,
    PointB=list_item_68.Item3,
    Offset=Slider(-1, range=-10..10),
    Text="{0:0.00}",
    Size=number_slider_18)
aligned_dimension_2 = AlignedDimension(
    Plane=list_item_68.Item,
    PointA=list_item_68.Item,
    PointB=list_item_68.Item3,
    Offset=Slider(1, range=-10..10),
    Text="{0:0.00}",
    Size=number_slider_18)
line_7 = Line(StartPoint=list_item_68.Item2, EndPoint=list_item_68.Item3)
line_8 = Line(StartPoint=list_item_68.Item, EndPoint=list_item_68.Item3)

line_geometry_16 = Data(brep_edges_8.Naked)

panel_92 = Panel(tree_branch_38)
pt = Point(tree_branch_39)
move_10 = Move(Geometry=pt, Motion=unit_z_6)  # -> Geometry, Transform
c_script = CSharpScript(face="Verdana", bold=Toggle(False), italics=Toggle(False), size="0.15", content=panel_92, pl=move_10.Geometry)  # -> out, A; inputs face: String, bold: Boolean, italics: Boolean, size: Double, content: String, pl: Plane
# ---------- c_script: C# usings ----------
using System.IO;
using System.Linq;
using System.Data;
using System.Drawing;
using System.Reflection;
using System.Windows.Forms;
using System.Xml;
using System.Xml.Linq;
using System.Runtime.InteropServices;

using Rhino.DocObjects;
using Rhino.Collections;
using GH_IO;
using GH_IO.Serialization;
# ---------- c_script: C# ----------
    if(size == 0)
      size = 1;

    if(!string.IsNullOrEmpty(face) && size > 0 && !string.IsNullOrEmpty(content) &&
      pl.IsValid)
    {
      using (var doc = Rhino.RhinoDoc.CreateHeadless(null))
      {
        var te = doc.Objects.AddText(content, pl, size, face, bold, italics);
        var txt = doc.Objects.Find(te) as Rhino.DocObjects.TextObject;

        if(txt != null)
        {
          var tt = txt.Geometry as Rhino.Geometry.TextEntity;
          A = tt.Explode();
        }
      }
    }
# ---------- end c_script ----------

mesh_brep_5 = MeshBrep(
    Brep=tree_branch_37,
    Settings={GridMaxCount=0, GridMinCount=16, JaggedSeams=False, MaxEdgeLength=0, MinEdgeLength=0.0001, MinTolerance=0, Refine=True, RefineAngle=0, RelativeTolerance=0.65, SimplePlanes=True, Tolerance=0})
mesh_colours_6 = MeshColours(Mesh=graft(mesh_brep_5), Colours=graft(colors_2))

# ----
# Move txt to the middle
bounding_box_8 = BoundingBox(Content=c_script.A, Plane=PlaneXY(0, 0, 0), UnionBox=True)  # -> Box, Box_2
dimensions = Dimensions(Surface=bounding_box_8.Box)  # -> UDimension, VDimension
unit_x = UnitX(Factor=expr("-x/2", dimensions.UDimension))
unit_y = UnitY(Factor=expr("x/2", dimensions.VDimension))
addition_2 = Addition(A=unit_x, B=unit_y)
move_11 = Move(Geometry=c_script.A, Motion=addition_2)  # -> Geometry, Transform

line_geometry_17 = Data([line_7, line_8])

function_floor_text_line = Data(move_11.Geometry)
function_floor_outline = Data(line_geometry_16)
function_floor_mesh = Mesh(mesh_colours_6)

function_floor_text_line_2 = Data(function_floor_text_line)

mesh_joined_function = Data(mesh_colours_5)
function_floor_mesh_2 = Mesh(function_floor_mesh)
stream_filter_14 = StreamFilter(
    Gate=select_display_mode,
    Stream0=mesh_spheres_2,
    Stream1=mesh_divided_function,
    Stream2=mesh_joined_function,
    Stream3=function_floor_mesh_2)

function_floor_outline_2 = Data(function_floor_outline)

joined_function_edges = Data(trim_tree_45)
stream_filter_15 = StreamFilter(Gate=select_display_mode, Stream0=line_geometry_14, Stream3=function_floor_outline_2)

stream_filter_16 = StreamFilter(
    Gate=select_display_mode,
    Stream1=divided_function_edges,
    Stream2=joined_function_edges,
    Stream3=function_floor_text_line_2)

merge_22 = Merge(Data1=stream_filter_15, Data2=stream_filter_9)
multipipe_3 = MultiPipe(Curves=merge_22, NodeSize=stream_filter, EndOffset=1, StrutSize=1, Segment=0, KinkAngle=panel_83, CubeFit=0)
mesh_from_subd = MeshFromSubD(SubD=multipipe_3, Density=2)
mesh_colours_7 = MeshColours(Mesh=mesh_from_subd, Colours=stream_filter_4)

merge_23 = Merge(Data1=stream_filter_16, Data2=stream_filter_7)
merge_24 = Merge(Data1=stream_filter_14, Data2=stream_filter_8)
clean_tree_9 = CleanTree(RemoveNulls=boolean_toggle_2, RemoveInvalid=boolean_toggle_2, RemoveEmpty=boolean_toggle_2, Tree=merge_24)

# ---- group: RH_OUT:mesh_1
mesh_spheres_3 = Mesh(merge_24)

# ---- group: RH_OUT:mesh_2
mesh_spheres_4 = Mesh(mesh_colours_7)

# ---- group: RH_OUT:text_lines
crv_2 = Curve(merge_23)

# ----
panel_93 = Panel(joined_floor_massings)

# ==== cluster Remap: Remaps numbers
data = ClusterInput()
min = ClusterInput()
max = ClusterInput()
bnd = Bounds(Numbers=data)
dom = ConstructDomain(DomainStart=min, DomainEnd=max)
remap = RemapNumbers(Value=data, Source=bnd, Target=dom)  # -> Mapped, Clipped
R = ClusterOutput(remap.Mapped)

# ==== cluster ListIndices: Creates list indices
list = ClusterInput()
list_length = ListLength(List=list)
series = Series(Start="0", Step="1", Count=list_length)
trim_tree = TrimTree(Tree=series, Depth="1")
indices = Data(trim_tree)
indices_2 = ClusterOutput(indices)
